# Grasshopper definition driverless_LIM_prototype [Jan-13 '21, 2137].gh (Grasshopper 1.0.7)

# https://github.com/richieBao/driverlessCity_LIM
file_path = FilePath("C:\Users\richi\omen-richiebao_s\omen_github\driverlessCity_LIM\database\driverlesscity_sqlit.db")

point = Point([Point(17.43733602, -10.50332197, 0), Point(14.66925011, -20.24288349, 0), Point(22.05081253, -36.44131212, 0), Point(13.74655481, -49.56408974, 0), Point(21.84576913, -60.94399847, 0), Point(19.59029172, -65.86504008, 0), Point(20.20542192, -79.1928611, 0)])
sql_read = SQLRead(database_sql=file_path, table="table_location_phmi")  # -> out, output
# ---------- sql_read: Python ----------
"""Read SQL table.
    Inputs:
        database_sql: SQL database file path
        table: Specify a table
    Output:
        output: table content"""

__author__ = "Richie Bao-Chicago.IIT(driverless city project)"
__version__ = "2020.11.30"

ghenv.Component.Name = 'SQL read'
ghenv.Component.NickName = 'SQL read'
ghenv.Component.Message = '0.0.1'
ghenv.Component.Category = 'driverless-city'
ghenv.Component.SubCategory = '0 :: SQL'
ghenv.Component.AdditionalHelpFromDocStrings = '5'

import rhinoscriptsyntax as rs
import sqlite3
import ghpythonlib.treehelpers as th
import Rhino

conn=sqlite3.connect(database_sql)
with conn:
    cur = conn.cursor()
    cur.execute("SELECT * FROM %s"%table)
    rows = cur.fetchall()


layerTree = th.list_to_tree(rows, source=[0,])
output=layerTree
# ---------- end sql_read ----------
sql_read_2 = SQLRead(database_sql=file_path, table="table_landmark")  # -> out, output; same code as sql_read
pts_attri = PointsAttribute(points=point, attribute=Slider(10, range=0..100))  # -> out, pts_attri; inputs points: list
# ---------- pts_attri: Python ----------
"""Provides a scripting component.
    Inputs:
        points: Specify some points with an attribute
        attribute: Configure points' attribute
    Output:
        pts_attri: points given with certian attribute"""

__author__ = "Richie Bao-Chicago.IIT(driverless city project)"
__version__ = "2020.11.30"

ghenv.Component.Name = 'points attribute'
ghenv.Component.NickName = 'pts attri'
ghenv.Component.Message = '0.0.1'
ghenv.Component.Category = 'driverless-city'
ghenv.Component.SubCategory = '1 :: SQL'
ghenv.Component.AdditionalHelpFromDocStrings = '5'

import rhinoscriptsyntax as rs
import ghpythonlib.treehelpers as th
pts_coordi=[[c for c in rs.PointCoordinates(pt)]+[attribute] for pt in points]
pts_attri=th.list_to_tree(pts_coordi, source=[0,])
# ---------- end pts_attri ----------
panel = Panel("""x
y
z
attribute""")
list_item = ListItem(List=sql_read.output, Index="1", Wrap=True)  # -> flatten(Item)
list_item_2 = ListItem(List=sql_read.output, Index="2", Wrap=True)  # -> flatten(Item)
list_item_3 = ListItem(List=sql_read_2.output, Index="1", Wrap=True)  # -> flatten(Item)
list_item_4 = ListItem(List=sql_read_2.output, Index="2", Wrap=True)  # -> flatten(Item)
sql_dump = SQLDump(database_sql=file_path, pts_attri=pts_attri.pts_attri, field=panel, table_name="pts_attri")  # -> out, prompt; inputs pts_attri: tree, field: list
# ---------- sql_dump: Python ----------
__author__ = "Richie Bao-Chicago.IIT(driverless city project)"
__version__ = "2020.11.30"

ghenv.Component.Name = 'SQL dump'
ghenv.Component.NickName = 'SQL dump'
ghenv.Component.Message = '0.0.1'
ghenv.Component.Category = 'driverless-city'
ghenv.Component.SubCategory = '1 :: SQL'
ghenv.Component.AdditionalHelpFromDocStrings = '5'

import rhinoscriptsyntax as rs
import rhinoscriptsyntax as rs
import sqlite3
import ghpythonlib.treehelpers as th
import Rhino

def create_table(conn, create_table_sql):
    """ create a table from the create_table_sql statement
    :param conn: Connection object
    :param create_table_sql: a CREATE TABLE statement
    :return:
    """
    try:
        c = conn.cursor()
        c.execute(create_table_sql)
    except Error as e:
        print(e)
        
def data2sqlite(conn,table_name,data):
    with conn:
        conn.executemany("insert into %s(x, y,z,attribute) values (?,?,?,?)"%table_name,data)
        conn.commit()
        
        
        

pts_attri_nested_list=th.tree_to_list(pts_attri)

conn=sqlite3.connect(database_sql)
sql_create_table = """CREATE TABLE IF NOT EXISTS %s (
                                id integer PRIMARY KEY AUTOINCREMENT,
                                %s real NOT NULL,
                                %s real NOT NULL,
                                %s real NOT NULL,
                                %s real NOT NULL

                            );"""%(table_name,field[0],field[1],field[2],field[3])

create_table(conn, sql_create_table)

data2sqlite(conn,table_name,pts_attri_nested_list)
prompt="dumpped the data!"
# ---------- end sql_dump ----------
construct_point = ConstructPoint(XCoordinate=list_item_3, YCoordinate=list_item_4, ZCoordinate=0)
# landmarks and PHMI
construct_point_2 = ConstructPoint(XCoordinate=list_item, YCoordinate=list_item_2, ZCoordinate=0)
panel_2 = Panel(pts_attri.pts_attri)
panel_3 = Panel(sql_dump.prompt)
panel_4 = Panel(sql_read_2.output)

sql_read_3 = SQLRead(database_sql=file_path, table="node")  # -> out, output; same code as sql_read
panel_5 = Panel(sql_read_3.output)
sql_read_4 = SQLRead(database_sql=file_path, table="way")  # -> out, output; same code as sql_read
way2pts = WayToPoints(sql_data=sql_read_4.output, field="tags")  # -> out, out_by_field; inputs sql_data: tree
# ---------- way2pts: Python ----------
"""Read SQL table.
    Inputs:
        sql_data: SQL data readed
        field: data field ready to handle
    Output:
        out_by_field: export data by the field specified"""

__author__ = "Richie Bao-Chicago.IIT(driverless city project)"
__version__ = "2020.12.09"

ghenv.Component.Name = 'way to points'
ghenv.Component.NickName = 'way2pts'
ghenv.Component.Message = '0.0.1'
ghenv.Component.Category = 'driverless-city'
ghenv.Component.SubCategory = '0 :: SQL'
ghenv.Component.AdditionalHelpFromDocStrings = '5'

import rhinoscriptsyntax as rs
import sqlite3
import ghpythonlib.treehelpers as th
import Rhino

data=th.tree_to_list(sql_data)

if field=='geometry':   
    x=[[v[0] for v in eval(d[2])] for d in data]
    y=[[v[1] for v in eval(d[2])] for d in data]
    
    out_by_field=th.list_to_tree([x,y],source=[0,0])
    
    
    
    
if field=='tags':
    tags=[d[11] for d in data]
    out_by_field=tags
# ---------- end way2pts ----------
way2pts_2 = WayToPoints(sql_data=sql_read_4.output, field="geometry")  # -> out, out_by_field, X, Y; inputs sql_data: tree
# ---------- way2pts_2: Python ----------
"""Read SQL table.
    Inputs:
        sql_data: SQL data readed
        field: data field ready to handle
    Output:
        out_by_field: export data by the field specified"""

__author__ = "Richie Bao-Chicago.IIT(driverless city project)"
__version__ = "2020.12.09"

ghenv.Component.Name = 'way to points'
ghenv.Component.NickName = 'way2pts'
ghenv.Component.Message = '0.0.1'
ghenv.Component.Category = 'driverless-city'
ghenv.Component.SubCategory = '0 :: SQL'
ghenv.Component.AdditionalHelpFromDocStrings = '5'

import rhinoscriptsyntax as rs
import sqlite3
import ghpythonlib.treehelpers as th
import Rhino

data=th.tree_to_list(sql_data)

if field=='geometry':   
    x=[[v[0] for v in eval(d[2])] for d in data]
    y=[[v[1] for v in eval(d[2])] for d in data]
    
    X=th.list_to_tree(x,source=[0,0])
    Y=th.list_to_tree(y,source=[0,0])
    
    
    
    
if field=='tags':
    tags=[d[11] for d in data]
    out_by_field=tags
# ---------- end way2pts_2 ----------
point_2 = Point(Point(18.18028534, -4.825244709, 0))
coordi2pts = CoordinatesStringToPoints(sql_data=sql_read_3.output, field="geometry")  # -> out, out_by_field; inputs sql_data: tree
# ---------- coordi2pts: Python ----------
"""Read SQL table.
    Inputs:
        sql_data: SQL data readed
        field: data field ready to handle
    Output:
        out_by_field: export data by the field specified"""

__author__ = "Richie Bao-Chicago.IIT(driverless city project)"
__version__ = "2020.12.09"

ghenv.Component.Name = 'coordinates string to points'
ghenv.Component.NickName = 'coordi2pts'
ghenv.Component.Message = '0.0.1'
ghenv.Component.Category = 'driverless-city'
ghenv.Component.SubCategory = '0 :: SQL'
ghenv.Component.AdditionalHelpFromDocStrings = '5'

import rhinoscriptsyntax as rs
import sqlite3
import ghpythonlib.treehelpers as th
import Rhino

data=th.tree_to_list(sql_data)

if field=='geometry':    
    x=[eval(d[2])[0] for d in data]
    y=[eval(d[2])[1] for d in data]
    
    out_by_field=th.list_to_tree([x,y],source=[0,0])
    
if field=='tags':
    tags=[d[11] for d in data]
    out_by_field=tags
# ---------- end coordi2pts ----------
coordi2pts_2 = CoordinatesStringToPoints(sql_data=sql_read_3.output, field="tags")  # -> out, out_by_field; inputs sql_data: tree; same code as coordi2pts
tags2group = TagsGroup(tags=way2pts.out_by_field, tag_given="building")  # -> out, tags_bool; inputs tags: list
# ---------- tags2group: Python ----------
"""Processing the tags of OSM.
    Inputs:
        tags: tags string
        field: data field ready to handle
    Output:
        labels: all of the tags name
        tags_bool: 
            """

__author__ = "Richie Bao-Chicago.IIT(driverless city project)"
__version__ = "2020.12.09"

ghenv.Component.Name = 'tags group'
ghenv.Component.NickName = 'tags2group'
ghenv.Component.Message = '0.0.1'
ghenv.Component.Category = 'driverless-city'
ghenv.Component.SubCategory = '0 :: SQL'
ghenv.Component.AdditionalHelpFromDocStrings = '5'

import rhinoscriptsyntax as rs
import sqlite3
import ghpythonlib.treehelpers as th
import Rhino

tag_b=[]
if tag_given is not None:
    for row in tags:
        #print(eval(row).keys())
        if tag_given in eval(row).keys():
            tag_b.append(1)
        else:
            tag_b.append(0)


tags_bool=tag_b
# ---------- end tags2group ----------
construct_point_3 = ConstructPoint(XCoordinate=way2pts_2.X, YCoordinate=way2pts_2.Y, ZCoordinate=0)
param_viewer = ParamViewer(way2pts.out_by_field)
rectangle = Rectangle(Plane=point_2, XSize=Slider(9.317, range=0..50), YSize=Slider(22.917, range=0..50), Radius=0)  # -> Rectangle, Length
unit_z = UnitZ(Factor=Slider(8.184, range=0..50))
locating = Point(Point(448005.0733, 4631675.45, 0))
match_text = MatchText(Text=coordi2pts_2.out_by_field, Pattern="{}", Case=True)
locating_2 = Point(Point(448059.0447, 4631708.776, 0))
flip_matrix = FlipMatrix(Data=coordi2pts.out_by_field)
polyline = PolyLine(Vertices=construct_point_3, Closed=False)
closest_obj_ikx = ClosestObjecIndx(objs=flatten(polyline), point=locating)  # -> out, closest_obj, obj_idx, closest_point; inputs objs: list
# ---------- closest_obj_ikx: Python ----------
"""find the nearest obj index.
    Inputs:
        objs: objects list
        point: a point used to find the nearest object
    Output:
        closest_obj: the closest object
        obj_idx: the closest object index
        closest_point:the nereast point projecting to the closest object
            """

__author__ = "Richie Bao-Chicago.IIT(driverless city project)"
__version__ = "2020.12.09"

ghenv.Component.Name = 'closest objec indx'
ghenv.Component.NickName = 'closest obj Ikx'
ghenv.Component.Message = '0.0.1'
ghenv.Component.Category = 'driverless-city'
ghenv.Component.SubCategory = '0 :: SQL'
ghenv.Component.AdditionalHelpFromDocStrings = '5'

import rhinoscriptsyntax as rs
import sqlite3
import ghpythonlib.treehelpers as th
import Rhino

results=rs.PointClosestObject(point,objs)
if results:
    obj=results[0]
    closest_point=results[1]

    idx=0
    for o in objs:
        if o==obj:
            obj_idx=idx
        idx+=1

closest_obj=obj
# ---------- end closest_obj_ikx ----------
extrude = Extrude(Base=rectangle.Rectangle, Direction=unit_z)
cull_pattern = CullPattern(List=flatten(polyline), CullPattern=flatten(tags2group.tags_bool))
gate_not = GateNot(A=match_text)
numbers_to_points = NumbersToPoints(Numbers=flip_matrix, Mask=2)
closest_point = ClosestPoint(Point=locating_2, Cloud=flatten(numbers_to_points))  # -> ClosestPoint, CPIndex, Distance
list_item_5 = ListItem(List=coordi2pts_2.out_by_field, Index=closest_point.CPIndex, Wrap=True)
cap_holes = CapHoles(Brep=extrude)
list_item_6 = ListItem(List=flatten(numbers_to_points), Index=closest_point.CPIndex, Wrap=True)
panel_6 = Panel(closest_obj_ikx.obj_idx)
panel_7 = Panel(polyline)
colour_swatch = ColourSwatch(SwatchColor=RGB(255, 0, 0))
custom_preview = CustomPreview(Geometry=closest_obj_ikx.closest_obj, Material=ColourSwatch(SwatchColor=RGB(255, 0, 208)))
cull_pattern_2 = CullPattern(List=flatten(numbers_to_points), CullPattern=gate_not)
panel_8 = Panel(cap_holes)
custom_preview_2 = CustomPreview(Geometry=cull_pattern, Material=ColourSwatch(SwatchColor=RGB(255, 255, 255)))
list_item_7 = ListItem(List=way2pts.out_by_field, Index=closest_obj_ikx.obj_idx, Wrap=True)
param_viewer_2 = ParamViewer(polyline)
dot_display = DotDisplay(Point=list_item_6, Colour=colour_swatch, Size=Slider(4.052, range=0..20))
text_tag_3d = TextTag3D(Location=list_item_6, Text=list_item_5, Size=Slider(4.052, range=0..20), Colour=colour_swatch, Justification=7)
dot_display_2 = DotDisplay(Point=flatten(cull_pattern_2), Colour=RGB(0, 0, 0), Size=Slider(2.122, range=0..20))
text_tag = TextTag(Location=list_item_6, Text=list_item_5, Colour=colour_swatch)
text = Text()
text_tag_3d_2 = TextTag3D(Location=locating, Text=list_item_7, Size=Slider(4.052, range=0..20), Colour=colour_swatch, Justification=7)
# OSM
panel_9 = Panel(match_text)
panel_10 = Panel(list_item_6)

sql_read_5 = SQLRead(database_sql=file_path, table="building_3d")  # -> out, output; same code as sql_read
panel_11 = Panel(sql_read_5.output)

tags2group_2 = TagsGroup(tags=way2pts.out_by_field, tag_given="highway")  # -> out, tags_bool; inputs tags: list; same code as tags2group
cull_pattern_3 = CullPattern(List=flatten(polyline), CullPattern=flatten(tags2group_2.tags_bool))
custom_preview_3 = CustomPreview(Geometry=cull_pattern_3, Material=ColourSwatch(SwatchColor=RGB(0, 0, 0)))

tags2group_3 = TagsGroup(tags=way2pts.out_by_field, tag_given="sport")  # -> out, tags_bool; inputs tags: list; same code as tags2group
cull_pattern_4 = CullPattern(List=flatten(polyline), CullPattern=flatten(tags2group_3.tags_bool))
custom_preview_4 = CustomPreview(Geometry=cull_pattern_4, Material=ColourSwatch(SwatchColor=RGB(18, 235, 255)))

tags2group_4 = TagsGroup(tags=way2pts.out_by_field, tag_given="amenity")  # -> out, tags_bool; inputs tags: list; same code as tags2group
cull_pattern_5 = CullPattern(List=flatten(polyline), CullPattern=flatten(tags2group_4.tags_bool))
custom_preview_5 = CustomPreview(Geometry=cull_pattern_5, Material=ColourSwatch(SwatchColor=RGB(181, 255, 186)))
