# Grasshopper definition driverless_LIM_prototype.gh (Grasshopper 1.0.7)

file_path = FilePath("C:\Users\richi\omen_richiebao\omen_github\driverlessCity_LIM\database\driverlesscity_sqlit.db")
# https://github.com/richieBao/driverlessCity_LIM
panel = Panel(file_path)
line = Line(Line((447976.5615, 4631662.26, 0), (447971.5602, 4632008.687, 0)))
divide_length = DivideLength(Curve=line, Length=Slider(5, range=0..10))  # -> Points, Tangents, Parameters

# ----
# 3D building
panel_2 = Panel("building_3d")
sql_read = SQLRead(database_sql=file_path, table=panel_2)  # -> out, output
# ---------- sql_read: Python ----------
"""Read SQL table.
    Inputs:
        database_sql: SQL database file path
        table: Specify a table
    Output:
        output: table content"""

__author__ = "Richie Bao-Chicago.IIT(driverless city project)"
__version__ = "2020.11.30"

ghenv.Component.Name = 'SQL read'
ghenv.Component.NickName = 'SQL read'
ghenv.Component.Message = '0.0.1'
ghenv.Component.Category = 'driverless-city'
ghenv.Component.SubCategory = '0 :: SQL'
ghenv.Component.AdditionalHelpFromDocStrings = '5'

import rhinoscriptsyntax as rs
import sqlite3
import ghpythonlib.treehelpers as th
import Rhino

conn=sqlite3.connect(database_sql)
with conn:
    cur = conn.cursor()
    cur.execute("SELECT * FROM %s"%table)
    rows = cur.fetchall()


layerTree = th.list_to_tree(rows, source=[0,])
output=layerTree
# ---------- end sql_read ----------
_3d_building = _3DBuilding(sql_data=sql_read.output)  # -> out, X, Y, height, properties; inputs sql_data: tree
# ---------- _3d_building: Python ----------
"""Read SQL table.
    Inputs:
        sql_data: SQL data readed 
        
    Output:
        X: building points Coordinate-x
        Y: building points Coordinate-y
        height:building height     
        properties: building properties
        """

__author__ = "Richie Bao-Chicago.IIT(driverless city project)"
__version__ = "2021.01.13"

ghenv.Component.Name = '3D building'
ghenv.Component.NickName = '3D building'
ghenv.Component.Message = '0.0.1'
ghenv.Component.Category = 'driverless-city'
ghenv.Component.SubCategory = '0 :: SQL'
ghenv.Component.AdditionalHelpFromDocStrings = '5'

import rhinoscriptsyntax as rs
import sqlite3
import ghpythonlib.treehelpers as th
import Rhino

data=th.tree_to_list(sql_data)


x=[[v[0] for v in eval(d[4])] for d in data]
y=[[v[1] for v in eval(d[4])] for d in data]
    
X=th.list_to_tree(x,source=[0,0])
Y=th.list_to_tree(y,source=[0,0])
height=[d[6] for d in data]
properties=[d[3] for d in data]
# ---------- end _3d_building ----------
panel_3 = Panel(_3d_building.properties)
panel_4 = Panel(_3d_building.Y)
construct_point = ConstructPoint(XCoordinate=_3d_building.X, YCoordinate=_3d_building.Y, ZCoordinate=0)
panel_5 = Panel(_3d_building.X)
panel_6 = Panel(_3d_building.height)
polyline = PolyLine(Vertices=construct_point, Closed=False)
unit_z = UnitZ(Factor=_3d_building.height)
boundary_surfaces = BoundarySurfaces(Edges=polyline)
extrude = Extrude(Base=flatten(boundary_surfaces), Direction=unit_z)
param_viewer = ParamViewer(_3d_building.height)
locating = Point(Point(447835.8587, 4631514.271, 0))
closest_obj_ikx = ClosestObjecIndx(objs=flatten(polyline), point=locating)  # -> out, closest_obj, obj_idx, closest_point; inputs objs: list
# ---------- closest_obj_ikx: Python ----------
"""find the nearest obj index.
    Inputs:
        objs: objects list
        point: a point used to find the nearest object
    Output:
        closest_obj: the closest object
        obj_idx: the closest object index
        closest_point:the nereast point projecting to the closest object
            """

__author__ = "Richie Bao-Chicago.IIT(driverless city project)"
__version__ = "2020.12.09"

ghenv.Component.Name = 'closest objec indx'
ghenv.Component.NickName = 'closest obj Ikx'
ghenv.Component.Message = '0.0.1'
ghenv.Component.Category = 'driverless-city'
ghenv.Component.SubCategory = '0 :: SQL'
ghenv.Component.AdditionalHelpFromDocStrings = '5'

import rhinoscriptsyntax as rs
import sqlite3
import ghpythonlib.treehelpers as th
import Rhino

results=rs.PointClosestObject(point,objs)
if results:
    obj=results[0]
    closest_point=results[1]

    idx=0
    for o in objs:
        if o==obj:
            obj_idx=idx
        idx+=1

closest_obj=obj
# ---------- end closest_obj_ikx ----------
list_item = ListItem(List=_3d_building.height, Index=closest_obj_ikx.obj_idx, Wrap=True)
unit_z_2 = UnitZ(Factor=list_item)
move = Move(Geometry=locating, Motion=unit_z_2)  # -> Geometry, Transform
list_item_2 = ListItem(List=_3d_building.properties, Index=closest_obj_ikx.obj_idx, Wrap=True)
text_tag_3d = TextTag3D(
    Location=move.Geometry,
    Text=list_item_2,
    Size=Slider(4.052, range=0..20),
    Colour=ColourSwatch(SwatchColor=RGB(255, 0, 0)),
    Justification=7)

# ----
# OSM
panel_7 = Panel("node")
sql_read_2 = SQLRead(database_sql=file_path, table=panel_7)  # -> out, output; same code as sql_read
panel_8 = Panel(sql_read_2.output)
sql_read_3 = SQLRead(database_sql=file_path, table="way")  # -> out, output; same code as sql_read
way2pts = WayToPoints(sql_data=sql_read_3.output, field="tags")  # -> out, out_by_field; inputs sql_data: tree
# ---------- way2pts: Python ----------
"""Read SQL table.
    Inputs:
        sql_data: SQL data readed
        field: data field ready to handle
    Output:
        out_by_field: export data by the field specified"""

__author__ = "Richie Bao-Chicago.IIT(driverless city project)"
__version__ = "2020.12.09"

ghenv.Component.Name = 'way to points'
ghenv.Component.NickName = 'way2pts'
ghenv.Component.Message = '0.0.1'
ghenv.Component.Category = 'driverless-city'
ghenv.Component.SubCategory = '0 :: SQL'
ghenv.Component.AdditionalHelpFromDocStrings = '5'

import rhinoscriptsyntax as rs
import sqlite3
import ghpythonlib.treehelpers as th
import Rhino

data=th.tree_to_list(sql_data)

if field=='geometry':   
    x=[[v[0] for v in eval(d[2])] for d in data]
    y=[[v[1] for v in eval(d[2])] for d in data]
    
    out_by_field=th.list_to_tree([x,y],source=[0,0])
    
    
    
    
if field=='tags':
    tags=[d[11] for d in data]
    out_by_field=tags
# ---------- end way2pts ----------
way2pts_2 = WayToPoints(sql_data=sql_read_3.output, field="geometry")  # -> out, out_by_field, X, Y; inputs sql_data: tree
# ---------- way2pts_2: Python ----------
"""Read SQL table.
    Inputs:
        sql_data: SQL data readed
        field: data field ready to handle
    Output:
        out_by_field: export data by the field specified"""

__author__ = "Richie Bao-Chicago.IIT(driverless city project)"
__version__ = "2020.12.09"

ghenv.Component.Name = 'way to points'
ghenv.Component.NickName = 'way2pts'
ghenv.Component.Message = '0.0.1'
ghenv.Component.Category = 'driverless-city'
ghenv.Component.SubCategory = '0 :: SQL'
ghenv.Component.AdditionalHelpFromDocStrings = '5'

import rhinoscriptsyntax as rs
import sqlite3
import ghpythonlib.treehelpers as th
import Rhino

data=th.tree_to_list(sql_data)

if field=='geometry':   
    x=[[v[0] for v in eval(d[2])] for d in data]
    y=[[v[1] for v in eval(d[2])] for d in data]
    
    X=th.list_to_tree(x,source=[0,0])
    Y=th.list_to_tree(y,source=[0,0])
    
    
    
    
if field=='tags':
    tags=[d[11] for d in data]
    out_by_field=tags
# ---------- end way2pts_2 ----------
point = Point(Point(18.18028534, -4.825244709, 0))
coordi2pts = CoordinatesStringToPoints(sql_data=sql_read_2.output, field="geometry")  # -> out, out_by_field; inputs sql_data: tree
# ---------- coordi2pts: Python ----------
"""Read SQL table.
    Inputs:
        sql_data: SQL data readed
        field: data field ready to handle
    Output:
        out_by_field: export data by the field specified"""

__author__ = "Richie Bao-Chicago.IIT(driverless city project)"
__version__ = "2020.12.09"

ghenv.Component.Name = 'coordinates string to points'
ghenv.Component.NickName = 'coordi2pts'
ghenv.Component.Message = '0.0.1'
ghenv.Component.Category = 'driverless-city'
ghenv.Component.SubCategory = '0 :: SQL'
ghenv.Component.AdditionalHelpFromDocStrings = '5'

import rhinoscriptsyntax as rs
import sqlite3
import ghpythonlib.treehelpers as th
import Rhino

data=th.tree_to_list(sql_data)

if field=='geometry':    
    x=[eval(d[2])[0] for d in data]
    y=[eval(d[2])[1] for d in data]
    
    out_by_field=th.list_to_tree([x,y],source=[0,0])
    
if field=='tags':
    tags=[d[11] for d in data]
    out_by_field=tags
# ---------- end coordi2pts ----------
coordi2pts_2 = CoordinatesStringToPoints(sql_data=sql_read_2.output, field="tags")  # -> out, out_by_field; inputs sql_data: tree; same code as coordi2pts
tags2group = TagsGroup(tags=way2pts.out_by_field, tag_given="building")  # -> out, tags_bool; inputs tags: list
# ---------- tags2group: Python ----------
"""Processing the tags of OSM.
    Inputs:
        tags: tags string
        field: data field ready to handle
    Output:
        labels: all of the tags name
        tags_bool: 
            """

__author__ = "Richie Bao-Chicago.IIT(driverless city project)"
__version__ = "2020.12.09"

ghenv.Component.Name = 'tags group'
ghenv.Component.NickName = 'tags2group'
ghenv.Component.Message = '0.0.1'
ghenv.Component.Category = 'driverless-city'
ghenv.Component.SubCategory = '0 :: SQL'
ghenv.Component.AdditionalHelpFromDocStrings = '5'

import rhinoscriptsyntax as rs
import sqlite3
import ghpythonlib.treehelpers as th
import Rhino

tag_b=[]
if tag_given is not None:
    for row in tags:
        #print(eval(row).keys())
        if tag_given in eval(row).keys():
            tag_b.append(1)
        else:
            tag_b.append(0)


tags_bool=tag_b
# ---------- end tags2group ----------
construct_point_2 = ConstructPoint(XCoordinate=way2pts_2.X, YCoordinate=way2pts_2.Y, ZCoordinate=0)
param_viewer_2 = ParamViewer(way2pts.out_by_field)
rectangle = Rectangle(Plane=point, XSize=Slider(9.317, range=0..50), YSize=Slider(22.917, range=0..50), Radius=0)  # -> Rectangle, Length
unit_z_3 = UnitZ(Factor=Slider(8.184, range=0..50))
locating_2 = Point(Point(448005.0733, 4631643.318, 0))
match_text = MatchText(Text=coordi2pts_2.out_by_field, Pattern="{}", Case=True)
locating_3 = Point(Point(448031.7195, 4631708.776, 0))
flip_matrix = FlipMatrix(Data=coordi2pts.out_by_field)
polyline_2 = PolyLine(Vertices=construct_point_2, Closed=False)
extrude_2 = Extrude(Base=rectangle.Rectangle, Direction=unit_z_3)
closest_obj_ikx_2 = ClosestObjecIndx(objs=flatten(polyline_2), point=locating_2)  # -> out, closest_obj, obj_idx, closest_point; inputs objs: list; same code as closest_obj_ikx
cull_pattern = CullPattern(List=flatten(polyline_2), CullPattern=flatten(tags2group.tags_bool))
gate_not = GateNot(A=match_text)
numbers_to_points = NumbersToPoints(Numbers=flip_matrix, Mask=2)
closest_point = ClosestPoint(Point=locating_3, Cloud=flatten(numbers_to_points))  # -> ClosestPoint, CPIndex, Distance
list_item_3 = ListItem(List=coordi2pts_2.out_by_field, Index=closest_point.CPIndex, Wrap=True)
cap_holes = CapHoles(Brep=extrude_2)
list_item_4 = ListItem(List=flatten(numbers_to_points), Index=closest_point.CPIndex, Wrap=True)
panel_9 = Panel(closest_obj_ikx_2.obj_idx)
panel_10 = Panel(polyline_2)
colour_swatch = ColourSwatch(SwatchColor=RGB(255, 0, 0))
custom_preview = CustomPreview(Geometry=closest_obj_ikx_2.closest_obj, Material=ColourSwatch(SwatchColor=RGB(255, 0, 208)))
cull_pattern_2 = CullPattern(List=flatten(numbers_to_points), CullPattern=gate_not)
panel_11 = Panel(cap_holes)
custom_preview_2 = CustomPreview(Geometry=cull_pattern, Material=ColourSwatch(SwatchColor=RGB(255, 255, 255)))
list_item_5 = ListItem(List=way2pts.out_by_field, Index=closest_obj_ikx_2.obj_idx, Wrap=True)
param_viewer_3 = ParamViewer(polyline_2)
dot_display = DotDisplay(Point=list_item_4, Colour=colour_swatch, Size=Slider(4.052, range=0..20))
text_tag_3d_2 = TextTag3D(Location=list_item_4, Text=list_item_3, Size=Slider(4.052, range=0..20), Colour=colour_swatch, Justification=7)
dot_display_2 = DotDisplay(Point=flatten(cull_pattern_2), Colour=RGB(0, 0, 0), Size=Slider(0.334, range=0..20))
text_tag = TextTag(Location=list_item_4, Text=list_item_3, Colour=colour_swatch)
text = Text()
text_tag_3d_3 = TextTag3D(Location=locating_2, Text=list_item_5, Size=Slider(4.052, range=0..20), Colour=colour_swatch, Justification=7)
panel_12 = Panel(match_text)
panel_13 = Panel(list_item_4)

# ----
# landmarks and PHMI
number_slider = Slider(10, range=0..100)
point_2 = Point([Point(17.43733602, -10.50332197, 0), Point(14.66925011, -20.24288349, 0), Point(22.05081253, -36.44131212, 0), Point(13.74655481, -49.56408974, 0), Point(21.84576913, -60.94399847, 0), Point(19.59029172, -65.86504008, 0), Point(20.20542192, -79.1928611, 0)])
sql_read_4 = SQLRead(database_sql=file_path, table="table_location_phmi")  # -> out, output; same code as sql_read
sql_read_5 = SQLRead(database_sql=file_path, table="table_landmark")  # -> out, output; same code as sql_read
pts_attri = PointsAttribute(points=point_2, attribute=number_slider)  # -> out, pts_attri; inputs points: list
# ---------- pts_attri: Python ----------
"""Provides a scripting component.
    Inputs:
        points: Specify some points with an attribute
        attribute: Configure points' attribute
    Output:
        pts_attri: points given with certian attribute"""

__author__ = "Richie Bao-Chicago.IIT(driverless city project)"
__version__ = "2020.11.30"

ghenv.Component.Name = 'points attribute'
ghenv.Component.NickName = 'pts attri'
ghenv.Component.Message = '0.0.1'
ghenv.Component.Category = 'driverless-city'
ghenv.Component.SubCategory = '1 :: SQL'
ghenv.Component.AdditionalHelpFromDocStrings = '5'

import rhinoscriptsyntax as rs
import ghpythonlib.treehelpers as th
pts_coordi=[[c for c in rs.PointCoordinates(pt)]+[attribute] for pt in points]
pts_attri=th.list_to_tree(pts_coordi, source=[0,])
# ---------- end pts_attri ----------
panel_14 = Panel("""x
y
z
attribute""")
list_item_6 = ListItem(List=sql_read_4.output, Index="1", Wrap=True)  # -> flatten(Item)
list_item_7 = ListItem(List=sql_read_4.output, Index="2", Wrap=True)  # -> flatten(Item)
list_item_8 = ListItem(List=sql_read_5.output, Index="1", Wrap=True)  # -> flatten(Item)
list_item_9 = ListItem(List=sql_read_5.output, Index="2", Wrap=True)  # -> flatten(Item)
sql_dump = SQLDump(database_sql=file_path, pts_attri=pts_attri.pts_attri, field=panel_14, table_name="pts_attri")  # -> out, prompt; inputs pts_attri: tree, field: list
# ---------- sql_dump: Python ----------
__author__ = "Richie Bao-Chicago.IIT(driverless city project)"
__version__ = "2020.11.30"

ghenv.Component.Name = 'SQL dump'
ghenv.Component.NickName = 'SQL dump'
ghenv.Component.Message = '0.0.1'
ghenv.Component.Category = 'driverless-city'
ghenv.Component.SubCategory = '1 :: SQL'
ghenv.Component.AdditionalHelpFromDocStrings = '5'

import rhinoscriptsyntax as rs
import rhinoscriptsyntax as rs
import sqlite3
import ghpythonlib.treehelpers as th
import Rhino

def create_table(conn, create_table_sql):
    """ create a table from the create_table_sql statement
    :param conn: Connection object
    :param create_table_sql: a CREATE TABLE statement
    :return:
    """
    try:
        c = conn.cursor()
        c.execute(create_table_sql)
    except Error as e:
        print(e)
        
def data2sqlite(conn,table_name,data):
    with conn:
        conn.executemany("insert into %s(x, y,z,attribute) values (?,?,?,?)"%table_name,data)
        conn.commit()
        
        
        

pts_attri_nested_list=th.tree_to_list(pts_attri)

conn=sqlite3.connect(database_sql)
sql_create_table = """CREATE TABLE IF NOT EXISTS %s (
                                id integer PRIMARY KEY AUTOINCREMENT,
                                %s real NOT NULL,
                                %s real NOT NULL,
                                %s real NOT NULL,
                                %s real NOT NULL

                            );"""%(table_name,field[0],field[1],field[2],field[3])

create_table(conn, sql_create_table)

data2sqlite(conn,table_name,pts_attri_nested_list)
prompt="dumpped the data!"
# ---------- end sql_dump ----------
construct_point_3 = ConstructPoint(XCoordinate=list_item_8, YCoordinate=list_item_9, ZCoordinate=0)
construct_point_4 = ConstructPoint(XCoordinate=list_item_6, YCoordinate=list_item_7, ZCoordinate=0)
panel_15 = Panel(pts_attri.pts_attri)
panel_16 = Panel(sql_dump.prompt)
panel_17 = Panel(sql_read_5.output)

list_item_10 = ListItem(List=divide_length.Points, Index=Slider(3, range=0..100), Wrap=True)

# ----
# traffic congestion
panel_18 = Panel("trafficCongestionSegs_current")
sql_read_6 = SQLRead(database_sql=file_path, table=panel_18)  # -> out, output; same code as sql_read
sql_read_7 = SQLRead(database_sql=file_path, table="trafficCongestionSegs_historical")  # -> out, output; same code as sql_read
traffic_congestion_current = TrafficCongestion_current(sql_data=sql_read_6.output)  # -> out, segs_start, segs_end, current_speed, street, direction, heading, segs_id; inputs sql_data: tree
# ---------- traffic_congestion_current: Python ----------
"""Read SQL table.
    Inputs:
        sql_data: SQL data readed 
        
    Output:
        X: building points Coordinate-x
        Y: building points Coordinate-y
        height:building height     
        properties: building properties
        """

__author__ = "Richie Bao-Chicago.IIT(driverless city project)"
__version__ = "2021.02.17"

ghenv.Component.Name = 'traffic congestion_current'
ghenv.Component.NickName = 'traffic congestion_current'
ghenv.Component.Message = '0.0.1'
ghenv.Component.Category = 'driverless-city'
ghenv.Component.SubCategory = '0 :: SQL'
ghenv.Component.AdditionalHelpFromDocStrings = '5'

import rhinoscriptsyntax as rs
import sqlite3
import ghpythonlib.treehelpers as th
import Rhino

data=th.tree_to_list(sql_data)

segs_start_=[list(eval(d[15])[0])+[0] for d in data]
#print(segs_start_)
segs_start=th.list_to_tree(segs_start_)

segs_end_=[list(eval(d[15])[1])+[0] for d in data]
segs_end=th.list_to_tree(segs_end_)

street=[d[2] for d in data]
direction=[d[3] for d in data]
heading=[d[7] for d in data]

current_speed=[d[13] for d in data]
segs_id=[d[1] for d in data]


'''
Chicago Traffic Tracker - Congestion Estimates by Segments

This dataset contains the current estimated speed for about 1250 segments covering 300 miles of arterial roads. For a more detailed description, go to: http://bit.ly/Q9AZAD.

The Chicago Traffic Tracker estimates traffic congestion on Chicago’s arterial streets (nonfreeway
streets) in real-time by continuously monitoring and analyzing GPS traces received from Chicago Transit Authority (CTA) buses. Two types of congestion estimates are produced every ten minutes: 1) by Traffic Segments and 2) by Traffic Regions or Zones. Congestion estimate by traffic segments gives the observed speed typically for one-half mile of a street in one direction of traffic.

Traffic Segment level congestion is available for about 300 miles of principal arterials. Congestion by Traffic Region gives the average traffic condition for all arterial street segments within a region. A traffic region is comprised of two or three community areas with comparable traffic patterns. 29 regions are created to cover the entire city (except O’Hare airport area).
This dataset contains the current estimated speed for about 1250 segments covering 300 miles of arterial roads.
There is much volatility in traffic segment speed. However, the congestion estimates for the traffic regions remain consistent for relatively longer period. Most volatility in arterial speed comes from the very nature of the arterials themselves. Due to a myriad of factors, including but not limited to frequent
intersections, traffic signals, transit movements, availability of alternative routes, crashes, short length of the segments, etc. speed on individual arterial segments can fluctuate from heavily congested to no congestion and back in a few minutes. The segment speed and traffic region congestion estimates
together may give a better understanding of the actual traffic conditions.

'''
# ---------- end traffic_congestion_current ----------
traffic_congestion_historical = TrafficCongestion_historical(sql_data=sql_read_7.output, segs_id=traffic_congestion_current.segs_id)  # -> out, speed, message_count, bus_count, segs_id; inputs sql_data: tree, segs_id: list
# ---------- traffic_congestion_historical: Python ----------
"""Read SQL table.
    Inputs:
        sql_data: SQL data readed 
        
    Output:
        X: building points Coordinate-x
        Y: building points Coordinate-y
        height:building height     
        properties: building properties
        """

__author__ = "Richie Bao-Chicago.IIT(driverless city project)"
__version__ = "2021.02.17"

ghenv.Component.Name = 'traffic congestion_historical'
ghenv.Component.NickName = 'traffic congestion_historical'
ghenv.Component.Message = '0.0.1'
ghenv.Component.Category = 'driverless-city'
ghenv.Component.SubCategory = '0 :: SQL'
ghenv.Component.AdditionalHelpFromDocStrings = '5'

import rhinoscriptsyntax as rs
import sqlite3
import ghpythonlib.treehelpers as th
import Rhino

data=th.tree_to_list(sql_data)

speed=[d[3] for d in data]
message_count=[d[2] for d in data]
bus_count=[d[1] for d in data]
segs_id=[d[0] for d in data]
vals_dict={id:[s,m,b]for id,s,m,b in zip(segs_id,speed,message_count,bus_count)}

if segs_id_:
    speed_=[]
    message_count_=[]
    bus_count_=[]
    for idx in segs_id_:
        if idx in segs_id:
            speed_.append(vals_dict[idx][0])
            message_count_.append(vals_dict[idx][1])
            bus_count_.append(vals_dict[idx][2])
        else:
            speed_.append(-1)
            message_count_.append(-1)
            bus_count_.append(-1)
    speed=speed_
    message_count=message_count_
    bus_count=bus_count_
    segs_id=segs_id_
    
    
'''
Chicago Traffic Tracker - Historical Congestion Estimates by Segment - 2011-2018

This dataset contains the historical estimated congestion for 1270 traffic segments, in selected time periods from August 2011 to May 2018. Newer records are in https://data.cityofchicago.org/d/sxs8-h27x. The most recent estimates for each segment are in https://data.cityofchicago.org/d/n4j6-wkkf.

The Chicago Traffic Tracker estimates traffic congestion on Chicago’s arterial streets (non-freeway streets) in real-time by continuously monitoring and analyzing GPS traces received from Chicago Transit Authority (CTA) buses. Two types of congestion estimates are produced every 10 minutes: 1) by Traffic Segments and 2) by Traffic Regions or Zones. Congestion estimates by traffic segments gives observed speed typically for one-half mile of a street in one direction of traffic. Traffic Segment level congestion is available for about 300 miles of principal arterials. Congestion by Traffic Region gives the average traffic condition for all arterial street segments within a region. A traffic region is comprised of two or three community areas with comparable traffic patterns. 29 regions are created to cover the entire city (except O’Hare airport area). There is much volatility in traffic segment speed. However, the congestion estimates for the traffic regions remain consistent for a relatively longer period. Most volatility in arterial speed comes from the very nature of the arterials themselves. Due to a myriad of factors, including but not limited to frequent intersections, traffic signals, transit movements, availability of alternative routes, crashes, short length of the segments, etc. Speed on individual arterial segments can fluctuate from heavily congested to no congestion and back in a few minutes. The segment speed and traffic region congestion estimates together may give a better understanding of the actual traffic conditions. Current estimates of traffic congestion by region are available at http://bit.ly/Vz3rIh.
'''
# ---------- end traffic_congestion_historical ----------
bounds = Bounds(Numbers=traffic_congestion_historical.speed)
numbers_to_points_2 = NumbersToPoints(Numbers=traffic_congestion_current.segs_end, Mask=4)
numbers_to_points_3 = NumbersToPoints(Numbers=traffic_congestion_current.segs_start, Mask=4)
deconstruct_domain = DeconstructDomain(Domain=bounds)  # -> Start, End
gradient = Gradient(
    LowerLimit=deconstruct_domain.Start,
    UpperLimit=deconstruct_domain.End,
    Parameter=traffic_congestion_historical.speed,
    stops=[0: RGB(0, 128, 0), 0.5: RGB(255, 255, 0), 1: RGB(255, 0, 0)])
line_2 = Line(StartPoint=numbers_to_points_3, EndPoint=numbers_to_points_2)
concatenate = Concatenate(Fragment_A=traffic_congestion_current.street, A=":", Fragment_B=traffic_congestion_historical.speed)
flatten_tree = FlattenTree(Tree=line_2, Path="{0}")
custom_preview_3 = CustomPreview(Geometry=flatten_tree, Material=gradient)
evaluate_length = EvaluateLength(Curve=line_2, Length=Slider(0.566, range=0..1), Normalized=True)  # -> flatten(Point), Tangent, Parameter
text_tag_3d_4 = TextTag3D(
    Location=evaluate_length.Point,
    Text=concatenate,
    Size=Slider(9.519, range=0..20),
    Colour=ColourSwatch(SwatchColor=RGB(255, 0, 0)),
    Justification=7)

point_3 = Point([Point(1.436683918, 1.02029791, 0), Point(1.425665918, 0.7507706946, 0), Point(1.137560199, 0.8349574307, 0), Point(1.02905285, 1.027651516, 0), Point(1.43502, 1.022039066, 0)])
delaunay_mesh = DelaunayMesh(Points=point_3, Plane=PlaneXY(0, 0, 0))
populate_geometry = PopulateGeometry(Geometry=delaunay_mesh, Count=Slider(1, range=0..20), Seed=Slider(10, range=0..20))
radius_proportion = Slider(9.156, range=0..20)
trunk_length = Slider(5.544, range=0..10)
number_slider_2 = Slider(5, range=0..20)
number_slider_3 = Slider(7, range=0..20)
point_4 = Point(Point(447984.5532, 4631663.687, 0))
fractal_tree_generator = FractalTreeGenerator(
    anchor_points=point_4,
    depth_recursion=number_slider_2,
    branches=number_slider_3,
    angle=Slider(33, range=0..50),
    min_h_branches_Spacing=Slider(35, range=0..100),
    trunk_length=trunk_length,
    branches_length_ratio=Slider(1, range=0..1),
    branches_angle_randomness=Slider(14, range=0..20),
    branches_length_randomness=Slider(56, range=0..100),
    branches_horizontal_distribution=Toggle(True),
    branches_radius_proportion=radius_proportion,
    branches_radius_ratio_extra=Slider(0.709, range=0..1),
    polygon_vertex_count=Slider(5.442, range=0..20),
    verticality=Slider(43, range=0..100),
    branches_growth_opportunity=Slider(44, range=0..100),
    leaf_length=Slider(0.078, range=0..1),
    leaf_width=Slider(0.098, range=0..1),
    leaves_num_max_LP=Slider(7, range=0..20),
    leaves_num_max_LB=Slider(6, range=0..20),
    branch_growth_depth=Slider(5, range=0..20))  # -> leaves, branches_out, trunk_radius, trunk_height; inputs anchor_points: Point3d, branches: Int32, branches_horizontal_distribution: Boolean, leaves_num_max_LB: Int32
# ---------- fractal_tree_generator: Python ----------
"""find the nearest obj index.
    Inputs:
        anchor_points: point3D, anchor point
        depth_recursion: integer, recursion cnt
        branches:integer, maximum amount of horizontal branches
        angle: float, split base angle
        min_h_branches_Spacing: float, minimum horizontal branches spacing
        trunk_length: float, first branch length
        branches_length_ratio: float, length change with each branch
        branches_angle_randomness: float, % of randomness in relation to base angle
        branches_length_randomness: float, % of randomness in relation to base length
        branches_horizontal_distribution: boolean, if horizontal branches evenly spaced or random
        branches_radius_proportion: float, proportion between starting length branch depth and branch radius
        branches_radius_ratio_extra: float, extra radius changes exept for one derived from lvariation
        polygon_vertex_count: interger, starting polygon vertex count
        verticality: float, angle smaller variation with higher branches, adds realism
        branches_growth_opportunity: chance that a branch will stop, increases with depth
        leaf_length: float, length of leaves
        leaf_width: float, width of leaves
        leaves_num_max_LP: int, maximum number of leaves growing from leafpoint
        leaves_num_max_LB: int, maximum number of leaf growth points on last branch
        branch_growth_depth: int, branch depth where leaves grow
        
    Output:
        closest_obj: the closest object
        obj_idx: the closest object index
        closest_point:the nereast point projecting to the closest object
            """

__author__ = "created by Pavlo Menshykh Procedural vegetation for BIM on June 12, 2019  (https://www.linkedin.com/pulse/procedural-vegetation-bim-pavlo-menshykh/); updated by Richie Bao-Chicago.IIT(driverless city project) on Wed Jan 20 12:19:17 2021"
__version__ = "2021.01.2"

ghenv.Component.Name = 'fractal tree generator'
ghenv.Component.NickName = 'fractal tree generator'
ghenv.Component.Message = '0.0.1'
ghenv.Component.Category = 'driverless-city'
ghenv.Component.SubCategory = '0 :: SQL'
ghenv.Component.AdditionalHelpFromDocStrings = '5'


#importing grasshopper python modules
import rhinoscriptsyntax as rs
import Rhino.Geometry as rg
import ghpythonlib.components as ghc
        
#importing generic modules
from math import cos
from math import sin
from math import radians
import random
from math import degrees

        
#getting starting point from anchor_pointsoint
x1 = anchor_points.X
y1 = anchor_points.Y
z1 = anchor_points.Z-trunk_length #to generate starting vector
        
#setting base variables
x2 = x1
y2 = y1 
z2 = anchor_points.Z #to generate starting vector
        
#setting first polygon
radiusbase = trunk_length/branches_radius_proportion
trunk_radius=radiusbase

stpntbase = rg.Point3d(x1, y1, z1)
stpntbaseend = rg.Point3d(x2, y2, z2)
vecbase = rg.Line(stpntbase, stpntbaseend)
plnbase = ghc.PlaneNormal(stpntbaseend, vecbase) #returns a plane perp to a vector
polygonbase = ghc.Polygon(plnbase, radiusbase, polygon_vertex_count, 0)[0] #returns a polygon and its perimeter

        
#base angle
anglerec = 0
anglerech = 0
cluster = [1]
branch_cluster = cluster[0]
        
verticality /= 100
branches_growth_opportunity /= 100
polygon_vertex_count -= 1 #first polygon_vertex_count is defined outside recursive func, so it should enter it with -1
        
depth = depth_recursion
        
#output list
pgons = {}
branches_out = [] #for debug purposes
leaves = []
        
#recursive function
def fractal(depth, x1, y1, z1, x2, y2, z2, trunk_length, anglerec, angle, branches_length_ratio, branches_angle_randomness, branches_length_randomness, anglerech, min_h_branches_Spacing, branches, verticality, branches_growth_opportunity, depth_recursion, branches_radius_proportion, branches_radius_ratio_extra, polygon_vertex_count, polygon, branch_cluster):
    global trunk_height
    #test if depth>0
    if depth:
        
        #defining random angle variation and trunk_length variation
        arn = random.uniform(-angle/100*branches_angle_randomness, angle/100*branches_angle_randomness)
        lrn = random.uniform(-trunk_length/100*branches_length_randomness, trunk_length/100*branches_length_randomness)
                
        if branches_horizontal_distribution == True:
            #defining horizontal rotation angles
            ahor = random.sample(range(0,360), branches)
            #removing numbers within tolerance
            ahr = rs.CullDuplicateNumbers(ahor, min_h_branches_Spacing)
            #in a 360 fashion
            if ahr[0]+360-min_h_branches_Spacing<ahr[-1]:
                del ahr[0]
        else:
            #generating evenly distributed angles
            ahr = range(0, 360+1, 360//branches)[:-1]
                
        #previous branch vector
        vecst = rg.Point3d(x1, y1, z1)
        vecend = rg.Point3d(x2, y2, z2)
        movevec = ghc.Vector2Pt(vecst, vecend, True)[0] #returns vector and it's trunk_length
                
        #perpendicular vector 
        rotplane3 = ghc.PlaneNormal(vecend, movevec) #creates plane perpendicular to vector
        plns = ghc.DeconstructPlane(rotplane3) #origin, x, y, z
        rotplane = ghc.ConstructPlane(plns[2], plns[1], plns[3]) #constructing new plane switching x and y planes to make perpendicular
                
        #generating perpendicular vector
        vecperp = ghc.Rotate(movevec, radians(90), rotplane)[0]
                
        #generating vector amplitudes
        leny = (trunk_length+lrn)*sin(radians((anglerec+arn)*(1-(verticality**depth))))
        lenz = (trunk_length+lrn)*cos(radians(anglerec+arn))
        ampy = ghc.Amplitude(vecperp, leny)
        ampz = ghc.Amplitude(movevec, lenz)
                
        #changing branch trunk_length dependant on branch depth
        trunk_length = trunk_length*branches_length_ratio
        trunk_height=trunk_length
                
        #building points
        endpoint1 = ghc.Move(vecend, ampz)[0] #returns moved object and transformation data
        endpoint = ghc.Move(endpoint1, ampy)[0] #returns moved object and transformation data
                
        #rotating point in a cone fashion
        rotpoint = ghc.Rotate3D(endpoint, radians(anglerech), vecend, movevec)[0] #returns rotated geometry and transformation data
                
        #building line between points
        linegeo = rg.Line(vecend, rotpoint)
                
        #defining recursion depth
        key = depth_recursion+1-depth
                
        #building geometry
        pln = ghc.PlaneNormal(rotpoint, linegeo) #returns a plane perp to a vector
        radius = trunk_length*(branches_radius_ratio_extra**(key))/branches_radius_proportion
                
        #reduce details with each branch, but not less than 3
        splits = 3 if polygon_vertex_count-key+1 <= 3 else polygon_vertex_count-key+1
                
        polygonend = ghc.Polygon(pln, radius, splits, 0)[0] #returns a polygon and its perimeter
                
        #aligning curves for loft creation
        crvst = ghc.EndPoints(polygon)[0]
        pntcld = ghc.Discontinuity(polygonend, 1) #returns points and point parameters
                
        #finind seam point
        closest_point = ghc.ClosestPoint(crvst, pntcld[0]) #returns closest point, closest point index, distance between closest points
        seampnt = pntcld[1][closest_point[1]]
        polygonend = ghc.Seam(polygonend, seampnt)
                
        lcurves = [polygon, polygonend]
                
        #building geometry
        geo = ghc.ExtrudePoint(polygon, rotpoint) if depth == 1 and splits == 3 else rg.Brep.CreateFromLoft(lcurves, rg.Point3d.Unset, rg.Point3d.Unset, rg.LoftType.Normal, False)[0]#if last branch than make a pyramid
        #make solid
        geocapped = ghc.CapHoles(geo)
                
        #building a dict of geo with depth as key, and geo as values
        pgons.update({branch_cluster:[geocapped]}) if branch_cluster not in pgons.keys() else pgons[branch_cluster].append(geocapped)
        branches_out.append(geocapped)
                
        #setting coords for next branch
        x1 = x2
        y1 = y2
        z1 = z2
                
        #getting xyz from rotated point
        x2 = rg.Point3d(rotpoint)[0]
        y2 = rg.Point3d(rotpoint)[1]
        z2 = rg.Point3d(rotpoint)[2]
                
        #setting base polygon for next branch
        polygon = polygonend
                
        #filling dict with branch clusters
        cluster.append(cluster[-1]+1)
        branch_cluster=cluster[-1]
                
        #calling function with different angle parameter for branch splitting, calling as many branches as spread within tolerance
        if depth != 1:
            for aa in ahr:
                if ((random.randint(40, 99)/100)**depth) < branches_growth_opportunity or depth == depth_recursion+1: #or added to prevent blank trees
                    fractal(depth - 1 , x1, y1, z1, x2, y2, z2, trunk_length, angle, angle, branches_length_ratio, branches_angle_randomness, branches_length_randomness, aa, min_h_branches_Spacing, branches, verticality, branches_growth_opportunity, depth_recursion, branches_radius_proportion, branches_radius_ratio_extra, polygon_vertex_count, polygon, branch_cluster)
        #leaf logic
        if depth <= branch_growth_depth and leaves_num_max_LB > 0 and leaves_num_max_LP > 0:
                    
            #vector for leaf growth spread
            leafpntvec = ghc.Vector2Pt(vecend, rotpoint, True)[0]
                    
            #setting leaf growth position on last barnch, leafpnt list
            lastbranchlength = ghc.Length(linegeo)
            leaves_list = [lastbranchlength] 
              #[leaves_list.append(lengthparam) for lengthparam in random.sample(range(0, int(lastbranchlength)), leaves_num_max_LB-1)] if leaves_num_max_LB > 1 else None
                    
            for leafpnt in leaves_list:
                leafamp = ghc.Amplitude(leafpntvec, leafpnt)
                leafpoint = ghc.Move(vecend, leafamp)[0]
                        
                #plane for leaf generation
                linetocenter = ghc.Line(stpntbase, leafpoint)
                planetocenter = ghc.PlaneNormal(leafpoint, linetocenter)
                        
                #create an imaginary circle with leaf_length radius and populate it with points for random leaf generation
                leafgenerationcircle = ghc.CircleCNR(leafpoint, linetocenter, leaf_length)
                circlesurf = ghc.BoundarySurfaces(leafgenerationcircle)
                leafcnt = random.randint(0, leaves_num_max_LP)
                if leafcnt > 0:
                    leafendpnts = ghc.PopulateGeometry(circlesurf, leafcnt, random.randint(1,500)) 
                            
                    def leafgenerator(point):
                        #random z move
                        zmove = rg.Vector3d(0, 0, 1)
                        moveamp = random.uniform(-leaf_length/3, leaf_length/5)
                        ampzmove = ghc.Amplitude(zmove, moveamp)
                        llendpnt = ghc.Move(point, ampzmove)[0]
                                
                        #setting a leaf centerline vector
                        leafvector = ghc.Vector2Pt(leafpoint, llendpnt, True)[0]
                        #defining leaf center point as avarage of st and end pnts
                        midpnt = ghc.Average([leafpoint, llendpnt])
                                
                        #generating perpendicular vector
                        vecperpleaf = ghc.Rotate(leafvector, radians(90), planetocenter)[0]
                        leafperpamp = ghc.Amplitude(vecperpleaf, random.uniform((leaf_width/2)/5*4, (leaf_width/2)/5*6))
                                
                        #moving mid point to both sides
                        midpnt1 = ghc.Move(midpnt, leafperpamp)[0]
                        midpnt2 = ghc.Move(midpnt, -leafperpamp)[0]
                                
                        #leaf geo
                        leafgeo = rg.NurbsSurface.CreateFromCorners(leafpoint, midpnt1, llendpnt, midpnt2)
                        leaves.append(leafgeo)
                            
                    #iterate over random number of generated points if list, else generate for one point
                    [leafgenerator(pp) for pp in leafendpnts] if isinstance(leafendpnts, list) else leafgenerator(leafendpnts)
                    
#first recursive function call
fractal(depth, x1, y1, z1, x2, y2, z2, trunk_length, anglerec, angle, branches_length_ratio, branches_angle_randomness, branches_length_randomness, anglerech, min_h_branches_Spacing, branches, verticality, branches_growth_opportunity, depth_recursion, branches_radius_proportion, branches_radius_ratio_extra, polygon_vertex_count, polygonbase, branch_cluster)
# ---------- end fractal_tree_generator ----------
panel_19 = Panel(fractal_tree_generator.trunk_radius)
list_length = ListLength(List=point_4)
list_length_2 = ListLength(List=point_4)
duplicate_data = DuplicateData(Data=number_slider_3, Number=list_length, Order=True)
duplicate_data_2 = DuplicateData(Data=number_slider_2, Number=list_length_2, Order=True)
param_viewer_4 = ParamViewer(fractal_tree_generator.leaves)
param_viewer_5 = ParamViewer(fractal_tree_generator.branches_out)

tags2group_2 = TagsGroup(tags=way2pts.out_by_field, tag_given="highway")  # -> out, tags_bool; inputs tags: list; same code as tags2group
cull_pattern_3 = CullPattern(List=flatten(polyline_2), CullPattern=flatten(tags2group_2.tags_bool))
custom_preview_4 = CustomPreview(Geometry=cull_pattern_3, Material=ColourSwatch(SwatchColor=RGB(0, 0, 0)))

tags2group_3 = TagsGroup(tags=way2pts.out_by_field, tag_given="sport")  # -> out, tags_bool; inputs tags: list; same code as tags2group
cull_pattern_4 = CullPattern(List=flatten(polyline_2), CullPattern=flatten(tags2group_3.tags_bool))
custom_preview_5 = CustomPreview(Geometry=cull_pattern_4, Material=ColourSwatch(SwatchColor=RGB(18, 235, 255)))

tags2group_4 = TagsGroup(tags=way2pts.out_by_field, tag_given="amenity")  # -> out, tags_bool; inputs tags: list; same code as tags2group
cull_pattern_5 = CullPattern(List=flatten(polyline_2), CullPattern=flatten(tags2group_4.tags_bool))
custom_preview_6 = CustomPreview(Geometry=cull_pattern_5, Material=ColourSwatch(SwatchColor=RGB(181, 255, 186)))

panel_20 = Panel("""3.6
56.2
6
9""")  # disabled
panel_21 = Panel("""5
3
6
9""")  # disabled
panel_22 = Panel("""sqlite
te
ere
tyt""")  # disabled
integer = Integer(panel_21)  # disabled
text_2 = Text(panel_22)  # disabled
number = Number(panel_20)  # disabled
entwine = Entwine(Branch00=integer, Branch01=text_2, Branch02=number, FlattenInputs=True)  # disabled
file_path_2 = FilePath("C:\Users\richi\omen-richiebao\omen_github\driverlessCity_LIM\database\testdb.db")  # disabled
panel_23 = Panel("""a
b
c""")  # disabled
flip_matrix_2 = FlipMatrix(Data=entwine)  # disabled
panel_24 = Panel("test_01")  # disabled
sql_dump_any = SQLDump_any(database_sql=file_path_2, attribute=flip_matrix_2, fields=panel_23, table_name=panel_24)  # -> out, prompt; inputs attribute: tree, fields: list; disabled
# ---------- sql_dump_any: Python ----------
__author__ = "Richie Bao-Chicago.IIT(driverless city project)"
__version__ = "2021.02.20"

ghenv.Component.Name = 'SQL dump_any'
ghenv.Component.NickName = 'SQL dump_any'
ghenv.Component.Message = '0.0.1'
ghenv.Component.Category = 'driverless-city'
ghenv.Component.SubCategory = '1 :: SQL'
ghenv.Component.AdditionalHelpFromDocStrings = '5'

import rhinoscriptsyntax as rs
import rhinoscriptsyntax as rs
import sqlite3
import ghpythonlib.treehelpers as th
import Rhino

def create_table(conn, sql_table,table_name):
    """ create a table from the create_table_sql statement
    :param conn: Connection object
    :param sql_table: a CREATE TABLE statement
    :return:
    """
    try:
        c = conn.cursor()        
        c.execute("DROP TABLE IF EXISTS %s"%table_name)        
        c.execute(sql_table)
    except Error as e:
        print(e)
        
def data2sqlite(conn,table_name,field,data):
    #print(data)
    sql_values_base="""INSERT INTO {}(""".format(table_name)
    for f in field:
        sql_values_base=sql_values_base+"{},".format(f)
    sql_values_base=sql_values_base[:-1]+") VALUES ("+"?,"*len(field)
    sql_values=sql_values_base[:-1]+")"
    with conn:
        print(data)
        data_=[list(i) for i in zip(*data)]
        print(data_)
        conn.executemany(sql_values,data)
        conn.commit()


    
    #conn.execute(sql_values,table_name)
    #conn.commit()

attribute_=th.tree_to_list(attribute)
#print(attribute_[0])
data_type=[type(i) for i in attribute_[0]]
data_type_list={str:'text',int:'integer',float:'real'}
field_type=[data_type_list[i] for i in data_type]
#print(field_type)

conn=sqlite3.connect(database_sql)
print("_"*50)

sql_table_base="""CREATE TABLE IF NOT EXISTS {} ( id integer PRIMARY KEY AUTOINCREMENT,""".format(table_name)
#print(sql_table_base)
for f,t in zip(fields,field_type):
    sql_table_base+="{} {} NOT NULL,".format(f,t)
sql_table=sql_table_base[:-1]+");"
#print(sql_table)
create_table(conn,sql_table,table_name)
data2sqlite(conn,table_name,fields,attribute_)
prompt="dumpped the data!"
# ---------- end sql_dump_any ----------
panel_25 = Panel(panel_23)  # disabled
panel_26 = Panel(sql_dump_any.prompt)  # disabled

radius_proportion_2 = Slider(9.156, range=0..20)  # disabled
number_slider_4 = Slider(0.709, range=0..1)  # disabled
trunk_length_2 = Slider(5.544, range=0..10)  # disabled
number_slider_5 = Slider(0.847, range=0..1)  # disabled
number_slider_6 = Slider(5, range=0..20)  # disabled
number_slider_7 = Slider(7, range=0..20)  # disabled
number_slider_8 = Slider(56, range=0..100)  # disabled
number_slider_9 = Slider(35, range=0..100)  # disabled
number_slider_10 = Slider(14, range=0..20)  # disabled
number_slider_11 = Slider(0.078, range=0..1)  # disabled
number_slider_12 = Slider(0.098, range=0..1)  # disabled
number_slider_13 = Slider(33, range=0..50)  # disabled
number_slider_14 = Slider(6, range=0..20)  # disabled
number_slider_15 = Slider(7, range=0..20)  # disabled
number_slider_16 = Slider(44, range=0..100)  # disabled
number_slider_17 = Slider(43, range=0..100)  # disabled
number_slider_18 = Slider(5, range=0..20)  # disabled
number_slider_19 = Slider(5.442, range=0..20)  # disabled
boolean_toggle = BooleanToggle(True)  # disabled
point_5 = Point([Point(447982.3621, 4631695.15, 0), Point(447989.5719, 4631712.21, 0), Point(447985.2054, 4631729.169, 0), Point(448009.1704, 4631727.544, 0)])  # disabled
fractal_tree_generator_2 = FractalTreeGenerator(
    anchor_points=point_5,
    depth_recursion=number_slider_6,
    branches=number_slider_7,
    angle=number_slider_13,
    min_h_branches_Spacing=number_slider_9,
    trunk_length=trunk_length_2,
    branches_length_ratio=number_slider_5,
    branches_angle_randomness=number_slider_10,
    branches_length_randomness=number_slider_8,
    branches_horizontal_distribution=boolean_toggle,
    branches_radius_proportion=radius_proportion_2,
    branches_radius_ratio_extra=number_slider_4,
    polygon_vertex_count=number_slider_19,
    verticality=number_slider_17,
    branches_growth_opportunity=number_slider_16,
    leaf_length=number_slider_11,
    leaf_width=number_slider_12,
    leaves_num_max_LP=number_slider_15,
    leaves_num_max_LB=number_slider_14,
    branch_growth_depth=number_slider_18)  # -> leaves, branches_out, trunk_radius, trunk_height; inputs anchor_points: Point3d, branches: Int32, branches_horizontal_distribution: Boolean, leaves_num_max_LB: Int32; disabled; same code as fractal_tree_generator
panel_27 = Panel(fractal_tree_generator_2.trunk_radius)  # disabled
panel_28 = Panel(fractal_tree_generator_2.trunk_height)  # disabled
list_length_3 = ListLength(List=point_5)  # disabled
list_length_4 = ListLength(List=point_5)  # disabled
duplicate_data_3 = DuplicateData(Data=number_slider_7, Number=list_length_3, Order=True)  # disabled
duplicate_data_4 = DuplicateData(Data=number_slider_6, Number=list_length_4, Order=True)  # disabled
param_viewer_6 = ParamViewer(fractal_tree_generator_2.leaves)  # disabled
param_viewer_7 = ParamViewer(fractal_tree_generator_2.branches_out)  # disabled
panel_29 = Panel(duplicate_data_3)  # disabled
panel_30 = Panel("""trunk_radius
trunk_height
branches_num
depth_recursion""")  # disabled
panel_31 = Panel("trees_attri")  # disabled

# ----
# trees
number_slider_20 = Slider(0.709, range=0..1)  # disabled
radius_proportion_3 = Slider(9.156, range=0..20)  # disabled
trunk_length_3 = Slider(5.544, range=0..10)  # disabled
number_slider_21 = Slider(0.768, range=0..1)  # disabled
number_slider_22 = Slider(5, range=0..20)  # disabled
number_slider_23 = Slider(7, range=0..20)  # disabled
number_slider_24 = Slider(33, range=0..50)  # disabled
number_slider_25 = Slider(56, range=0..100)  # disabled
number_slider_26 = Slider(14, range=0..20)  # disabled
number_slider_27 = Slider(0.078, range=0..1)  # disabled
number_slider_28 = Slider(0.098, range=0..1)  # disabled
number_slider_29 = Slider(6, range=0..20)  # disabled
number_slider_30 = Slider(7, range=0..20)  # disabled
number_slider_31 = Slider(44, range=0..100)  # disabled
number_slider_32 = Slider(43, range=0..100)  # disabled
number_slider_33 = Slider(5, range=0..20)  # disabled
number_slider_34 = Slider(5.442, range=0..20)  # disabled
number_slider_35 = Slider(35, range=0..100)  # disabled
boolean_toggle_2 = BooleanToggle(True)  # disabled
point_6 = Point([Point(448003.224, 4631799.576, 0), Point(447979.9016, 4631853.995, 0), Point(447984.8252, 4631900.64, 0), Point(447978.0876, 4631943.657, 0), Point(447982.2338, 4631955.318, 0), Point(447980.679, 4631964.129, 0), Point(447984.3069, 4631968.794, 0), Point(447979.3833, 4632008.183, 0)])  # disabled
fractal_tree_generator_3 = FractalTreeGenerator(
    anchor_points=point_6,
    depth_recursion=number_slider_22,
    branches=number_slider_23,
    angle=number_slider_24,
    min_h_branches_Spacing=number_slider_35,
    trunk_length=trunk_length_3,
    branches_length_ratio=number_slider_21,
    branches_angle_randomness=number_slider_26,
    branches_length_randomness=number_slider_25,
    branches_horizontal_distribution=boolean_toggle_2,
    branches_radius_proportion=radius_proportion_3,
    branches_radius_ratio_extra=number_slider_20,
    polygon_vertex_count=number_slider_34,
    verticality=number_slider_32,
    branches_growth_opportunity=number_slider_31,
    leaf_length=number_slider_27,
    leaf_width=number_slider_28,
    leaves_num_max_LP=number_slider_30,
    leaves_num_max_LB=number_slider_29,
    branch_growth_depth=number_slider_33)  # -> leaves, branches_out, trunk_radius, trunk_height; inputs anchor_points: Point3d, branches: Int32, branches_horizontal_distribution: Boolean, leaves_num_max_LB: Int32; disabled; same code as fractal_tree_generator
panel_32 = Panel(fractal_tree_generator_3.trunk_radius)  # disabled
list_length_5 = ListLength(List=point_6)  # disabled
list_length_6 = ListLength(List=point_6)  # disabled
duplicate_data_5 = DuplicateData(Data=number_slider_23, Number=list_length_5, Order=True)  # disabled
duplicate_data_6 = DuplicateData(Data=number_slider_22, Number=list_length_6, Order=True)  # disabled
param_viewer_8 = ParamViewer(fractal_tree_generator_3.leaves)  # disabled
param_viewer_9 = ParamViewer(fractal_tree_generator_3.branches_out)  # disabled
panel_33 = Panel(fractal_tree_generator_3.trunk_height)  # disabled
deconstruct = Deconstruct(Point=point_4)  # -> XComponent, YComponent, ZComponent; disabled
deconstruct_2 = Deconstruct(Point=point_5)  # -> XComponent, YComponent, ZComponent; disabled
deconstruct_3 = Deconstruct(Point=point_6)  # -> XComponent, YComponent, ZComponent; disabled
entwine_2 = Entwine(Branch00=fractal_tree_generator.leaves, Branch01=fractal_tree_generator.branches_out, FlattenInputs=True)
entwine_3 = Entwine(
    Branch00=deconstruct.ZComponent,
    Branch01=deconstruct_2.ZComponent,
    Branch02=deconstruct_3.ZComponent,
    FlattenInputs=True)  # -> flatten(Result); disabled
entwine_4 = Entwine(
    Branch00=deconstruct.YComponent,
    Branch01=deconstruct_2.YComponent,
    Branch02=deconstruct_3.YComponent,
    FlattenInputs=True)  # -> flatten(Result); disabled
entwine_5 = Entwine(
    Branch00=deconstruct.XComponent,
    Branch01=deconstruct_2.XComponent,
    Branch02=deconstruct_3.XComponent,
    FlattenInputs=True)  # -> flatten(Result); disabled
entwine_6 = Entwine(FlattenInputs=True)
panel_34 = Panel("""trunk_radius
trunk_height
branches_num
depth_recursion
X
Y
Z""")  # disabled
panel_35 = Panel("trees_attri_")  # disabled

# ----
# lidar
flatten_tree_2 = FlattenTree(Tree=entwine_2, Path="{0}")
point_7 = Point(Point(447976.2101, 4631659.422, 0))
panel_36 = Panel("0.2")
panel_37 = Panel("128")
panel_38 = Panel("200")
lidar_rays = LidarRays(
    position_xy=list_item_10,
    height="1.50",
    vertical_deg_min="-25",
    vertical_deg_max="15",
    horizontal_deg="360",
    distance="60",
    channel="5",
    H_angle_resolution="5",
    sphere_radius=Slider(0.436, range=0..1))  # -> out, lidar_rays, rays_num, position_pt, position_sphere, region; inputs position_xy: Point3d
# ---------- lidar_rays: Python ----------
"""Read SQL table.
    Inputs:
        sql_data: SQL data readed 
        
    Output:
        X: building points Coordinate-x
        Y: building points Coordinate-y
        height:building height     
        properties: building properties
        """

__author__ = "Richie Bao-Chicago.IIT(driverless city project)"
__version__ = "2021.01.27"

ghenv.Component.Name = 'lidar rays'
ghenv.Component.NickName = 'lidar rays'
ghenv.Component.Message = '0.0.1'
ghenv.Component.Category = 'driverless-city'
ghenv.Component.SubCategory = '0 :: SQL'
ghenv.Component.AdditionalHelpFromDocStrings = '5'

import rhinoscriptsyntax as rs
import ghpythonlib.treehelpers as th

position_original=position_xy[0],position_xy[1],height
position_pt=position_original

basic_matrix=rs.XformTranslation((distance,0,0))
basic_end_point=rs.PointTransform(position_original,basic_matrix)
basic_ray=rs.AddLine(position_original,basic_end_point)

vertical_domain=vertical_deg_max-vertical_deg_min
vertical_angle_resolution=vertical_domain/channel

vertical_angles=[]
angle_up=0
while True:
    vertical_angles.append(angle_up)
    angle_up+=vertical_angle_resolution
    
    if angle_up>vertical_deg_max:
        break
angle_down=0
while True:
    angle_down-=vertical_angle_resolution
    vertical_angles.append(angle_down)
    if angle_down<=vertical_deg_min:
        break
rays_section=[rs.RotateObject(basic_ray,position_original,angle,axis=rs.VectorCreate((0,0,0),(0,1,0)),copy=True) for angle in vertical_angles]

horizontal_angles=[]
horizontal_angle=0
while True:
    horizontal_angles.append(horizontal_angle)
    horizontal_angle+=H_angle_resolution 
    if horizontal_angle>horizontal_deg:
        break

rays=[[rs.RotateObject(ray,position_original,angle,axis=rs.VectorCreate((0,0,0),(0,0,1)),copy=True) for ray in rays_section] for angle in horizontal_angles]
rays_tree=th.list_to_tree(rays, source=[0,])

lidar_rays=rays_tree
rays_num=len(vertical_angles)*len(horizontal_angles)

position_sphere=rs.AddSphere(position_original, sphere_radius)

#region_section= rs.AddLoftSrf(rays_section)
#region=rs.AddRevSrf(region_section, axis=((0,0,0), (0,0,1)), start_angle=0.0, end_angle=360.0)
region_section=rs.AddRevSrf(basic_ray, axis=(position_original, (1,0,0)), start_angle=vertical_deg_min, end_angle=vertical_deg_max)
region_edge=rs.DuplicateEdgeCurves(region_section, True )

#plane_arc_rotate=rs.RotatePlane(plane_arc, 90-vertical_deg_max, plane_arc.ZAxis)
#arc=rs.AddArc(plane_arc_rotate,distance ,45)
#plane=rs.MovePlane(rs.WorldZXPlane(),position_original)



rev_matrix=rs.XformTranslation((0,0,1))
rev_end_point=rs.PointTransform(position_original,rev_matrix)


region=rs.AddRevSrf(rs.JoinCurves(region_edge),(position_original,rev_end_point))
# ---------- end lidar_rays ----------
shape_in_brep = ShapeInBrep(Brep=lidar_rays.region, Shape=flatten_tree_2)
shape_in_brep_2 = ShapeInBrep(Brep=lidar_rays.region, Shape=extrude)
panel_39 = Panel("""0
1""")
panel_40 = Panel("""0
1""")
numbers_to_points_4 = NumbersToPoints(Numbers=lidar_rays.position_pt, Mask=4)
ghpython_script = GhPythonScript(first_values=shape_in_brep_2, second_values=panel_39)  # -> out, equality; inputs first_values: list, second_values: list
# ---------- ghpython_script: Python ----------
__author__ = "richi"
__version__ = "2021.01.27"

import rhinoscriptsyntax as rs
equality=[True if i in second_values else False for i in first_values]
# ---------- end ghpython_script ----------
panel_41 = Panel(lidar_rays.rays_num)
ghpython_script_2 = GhPythonScript(first_values=shape_in_brep, second_values=panel_40)  # -> out, equality; inputs first_values: list, second_values: list; same code as ghpython_script
geometry = Geometry(lidar_rays.region)
geometry_2 = Geometry(lidar_rays.lidar_rays)
cull_pattern_6 = CullPattern(List=flatten_tree_2, CullPattern=ghpython_script_2.equality)
cull_pattern_7 = CullPattern(List=extrude, CullPattern=ghpython_script.equality)
flatten_tree_3 = FlattenTree(Tree=lidar_rays.lidar_rays, Path="{0}")
custom_preview_7 = CustomPreview(Geometry=geometry, Material=ColourSwatch(SwatchColor=RGBA(255, 255, 255, 29)))
ghpython_script_3 = GhPythonScript(rays=flatten_tree_3, geometry=cull_pattern_6, position=numbers_to_points_4)  # -> out, pts_proj; inputs rays: list of Line, geometry: list, position: Point3d
# ---------- ghpython_script_3: Python ----------
__author__ = "richi"
__version__ = "2021.01.27"

import rhinoscriptsyntax as rs
import ghpythonlib.treehelpers as th

#print(rays[0][1])
#print(rays[0][0])
vectors=[rs.VectorCreate(i[0],i[1]) for i in rays]

#pts_proj=th.list_to_tree([rs.ProjectPointToSurface(position, geometry, v) for v in vectors])
pts_proj=[]
for v in vectors:
    proj_pts=rs.ProjectPointToSurface(position, geometry, v)
    #print(proj_pts)
    #cloud=rs.PointCloudPoints([i for i in proj_pts])
    index=rs.PointArrayClosestPoint(proj_pts, position)
    print(index)
    if index!=None:
        pts_proj.append(proj_pts[index])
# ---------- end ghpython_script_3 ----------
pts_projection = PtsProjection(rays=flatten_tree_3, geometry=cull_pattern_7, position=numbers_to_points_4)  # -> out, pts_proj; inputs rays: list of Line, geometry: list, position: Point3d
# ---------- pts_projection: Python ----------
"""Read SQL table.
    Inputs:
        sql_data: SQL data readed 
        
    Output:
        X: building points Coordinate-x
        Y: building points Coordinate-y
        height:building height     
        properties: building properties
        """

__author__ = "Richie Bao-Chicago.IIT(driverless city project)"
__version__ = "2021.01.27"

ghenv.Component.Name = 'pts projection'
ghenv.Component.NickName = 'pts projection'
ghenv.Component.Message = '0.0.1'
ghenv.Component.Category = 'driverless-city'
ghenv.Component.SubCategory = '0 :: SQL'
ghenv.Component.AdditionalHelpFromDocStrings = '5'

import rhinoscriptsyntax as rs
import ghpythonlib.treehelpers as th

#print(rays[0][1])
#print(rays[0][0])
vectors=[rs.VectorCreate(i[0],i[1]) for i in rays]

#pts_proj=th.list_to_tree([rs.ProjectPointToSurface(position, geometry, v) for v in vectors])
pts_proj=[]
for v in vectors:
    proj_pts=rs.ProjectPointToSurface(position, geometry, v)
    #print(proj_pts)
    #cloud=rs.PointCloudPoints([i for i in proj_pts])
    index=rs.PointArrayClosestPoint(proj_pts, position)
    print(index)
    if index!=None:
        pts_proj.append(proj_pts[index])
# ---------- end pts_projection ----------
entwine_7 = Entwine(Branch00=pts_projection.pts_proj, Branch01=ghpython_script_3.pts_proj, FlattenInputs=True)

numbers_to_points_5 = NumbersToPoints(Numbers=lidar_rays.position_pt, Mask=4)
cloud_display = CloudDisplay(Points=numbers_to_points_5, Colours=RGB(255, 20, 147), Size=Slider(4.717, range=0..10), SpriteType=0)
panel_42 = Panel(lidar_rays.position_pt)
custom_preview_8 = CustomPreview(Geometry=geometry_2, Material=ColourSwatch(SwatchColor=RGBA(107, 107, 107, 29)))

entwine_8 = Entwine(Branch00=duplicate_data, Branch01=duplicate_data_3, Branch02=duplicate_data_6, FlattenInputs=True)  # disabled
entwine_9 = Entwine(
    Branch00=fractal_tree_generator.trunk_radius,
    Branch01=fractal_tree_generator_2.trunk_radius,
    Branch02=fractal_tree_generator_3.trunk_radius,
    FlattenInputs=True)  # disabled
entwine_10 = Entwine(
    Branch00=fractal_tree_generator.trunk_height,
    Branch01=fractal_tree_generator_2.trunk_height,
    Branch02=fractal_tree_generator_3.trunk_height,
    FlattenInputs=True)  # disabled
entwine_11 = Entwine(Branch00=duplicate_data_2, Branch01=duplicate_data_4, Branch02=duplicate_data_5, FlattenInputs=True)  # disabled
param_viewer_10 = ParamViewer(entwine_9)  # disabled
param_viewer_11 = ParamViewer(entwine_10)  # disabled
param_viewer_12 = ParamViewer(entwine_8)  # disabled
param_viewer_13 = ParamViewer(entwine_11)  # disabled
panel_43 = Panel(entwine_9)  # disabled
panel_44 = Panel(entwine_11)  # disabled
entwine_12 = Entwine(Branch00=entwine_9, Branch01=entwine_10, Branch02=entwine_8, Branch03=entwine_11, FlattenInputs=True)  # disabled
flip_matrix_3 = FlipMatrix(Data=entwine_12)  # disabled
param_viewer_14 = ParamViewer(flip_matrix_3)  # disabled
panel_45 = Panel(flip_matrix_3)  # disabled
sql_dump_2 = SQLDump(database_sql=file_path, pts_attri=flip_matrix_3, field=panel_30, table_name=panel_31)  # -> out, prompt; inputs pts_attri: tree, field: list; disabled
# ---------- sql_dump_2: Python ----------
__author__ = "Richie Bao-Chicago.IIT(driverless city project)"
__version__ = "2020.11.30"

ghenv.Component.Name = 'SQL dump'
ghenv.Component.NickName = 'SQL dump'
ghenv.Component.Message = '0.0.1'
ghenv.Component.Category = 'driverless-city'
ghenv.Component.SubCategory = '1 :: SQL'
ghenv.Component.AdditionalHelpFromDocStrings = '5'

import rhinoscriptsyntax as rs
import rhinoscriptsyntax as rs
import sqlite3
import ghpythonlib.treehelpers as th
import Rhino

def create_table(conn, create_table_sql,table_name):
    """ create a table from the create_table_sql statement
    :param conn: Connection object
    :param create_table_sql: a CREATE TABLE statement
    :return:
    """
    
    
    try:
        c = conn.cursor()
        
        c.execute("DROP TABLE IF EXISTS %s"%table_name)
        
        c.execute(create_table_sql)
    except Error as e:
        print(e)
        
def data2sqlite(conn,table_name,field,data):
    with conn:
        conn.executemany("insert into {}({}, {},{},{}) values (?,?,?,?)".format(table_name,field[0],field[1],field[2],field[3]),data)
        conn.commit()
        
        
        

pts_attri_nested_list=th.tree_to_list(pts_attri)

conn=sqlite3.connect(database_sql)
sql_create_table = """CREATE TABLE IF NOT EXISTS %s (
                                id integer PRIMARY KEY AUTOINCREMENT,
                                %s real NOT NULL,
                                %s real NOT NULL,
                                %s real NOT NULL,
                                %s real NOT NULL

                            );"""%(table_name,field[0],field[1],field[2],field[3])
                            
                            
                            
print(sql_create_table)

create_table(conn, sql_create_table,table_name)

data2sqlite(conn,table_name,field,pts_attri_nested_list)
prompt="dumpped the data!"
# ---------- end sql_dump_2 ----------
panel_46 = Panel(sql_dump_2.prompt)  # disabled

entwine_13 = Entwine(
    Branch00=entwine_9,
    Branch01=entwine_10,
    Branch02=entwine_8,
    Branch03=entwine_11,
    Branch04=entwine_5,
    Branch05=entwine_4,
    Branch06=entwine_3,
    FlattenInputs=True)  # disabled
flip_matrix_4 = FlipMatrix(Data=entwine_13)  # disabled
param_viewer_15 = ParamViewer(entwine_13)  # disabled
sql_dump_any_2 = SQLDump_any(database_sql=file_path, attribute=flip_matrix_4, fields=panel_34, table_name=panel_35)  # -> prompt; inputs attribute: tree, fields: list; disabled
# ---------- sql_dump_any_2: Python ----------
__author__ = "Richie Bao-Chicago.IIT(driverless city project)"
__version__ = "2021.02.20"

ghenv.Component.Name = 'SQL dump_any'
ghenv.Component.NickName = 'SQL dump_any'
ghenv.Component.Message = '0.0.1'
ghenv.Component.Category = 'driverless-city'
ghenv.Component.SubCategory = '1 :: SQL'
ghenv.Component.AdditionalHelpFromDocStrings = '5'

import rhinoscriptsyntax as rs
import rhinoscriptsyntax as rs
import sqlite3
import ghpythonlib.treehelpers as th
import Rhino

def create_table(conn, sql_table,table_name):
    """ create a table from the create_table_sql statement
    :param conn: Connection object
    :param sql_table: a CREATE TABLE statement
    :return:
    """
    try:
        c = conn.cursor()        
        c.execute("DROP TABLE IF EXISTS %s"%table_name)        
        c.execute(sql_table)
    except Error as e:
        print(e)
        
def data2sqlite(conn,table_name,field,data):
    #print(data)
    sql_values_base="""INSERT INTO {}(""".format(table_name)
    for f in field:
        sql_values_base=sql_values_base+"{},".format(f)
    sql_values_base=sql_values_base[:-1]+") VALUES ("+"?,"*len(field)
    sql_values=sql_values_base[:-1]+")"
    with conn:
        #print(data)
        data_=[list(i) for i in zip(*data)]
        #print(data_)
        conn.executemany(sql_values,data)
        conn.commit()


    
    #conn.execute(sql_values,table_name)
    #conn.commit()

attribute_=th.tree_to_list(attribute)
#print(attribute_[0])
data_type=[type(i) for i in attribute_[0]]
data_type_list={str:'text',int:'integer',float:'real'}
field_type=[data_type_list[i] for i in data_type]
#print(field_type)

conn=sqlite3.connect(database_sql)
#print("_"*50)

sql_table_base="""CREATE TABLE IF NOT EXISTS {} ( id integer PRIMARY KEY AUTOINCREMENT,""".format(table_name)
#print(sql_table_base)
for f,t in zip(fields,field_type):
    sql_table_base+="{} {} NOT NULL,".format(f,t)
sql_table=sql_table_base[:-1]+");"
#print(sql_table)
create_table(conn,sql_table,table_name)
data2sqlite(conn,table_name,fields,attribute_)
prompt="dumpped the data!"
# ---------- end sql_dump_any_2 ----------
panel_47 = Panel(flip_matrix_4)  # disabled
