# Grasshopper definition fractal tree generator.gh (Grasshopper 1.0.7)

radius_proportion = Slider(9.156, range=0..20)
trunk_length = Slider(1.176, range=0..10)
point = Point([Point(1.436683918, 1.02029791, 0), Point(1.425665918, 0.7507706946, 0), Point(1.137560199, 0.8349574307, 0), Point(1.02905285, 1.027651516, 0), Point(1.43502, 1.022039066, 0)])
delaunay_mesh = DelaunayMesh(Points=point, Plane=PlaneXY(0, 0, 0))
populate_geometry = PopulateGeometry(Geometry=delaunay_mesh, Count=Slider(1, range=0..20), Seed=Slider(10, range=0..20))
fractal_tree_generator = FractalTreeGenerator(
    anchor_points=populate_geometry,
    depth_recursion=Slider(4, range=0..20),
    branches=Slider(7, range=0..20),
    angle=Slider(33, range=0..50),
    min_h_branches_Spacing=Slider(35, range=0..100),
    trunk_length=trunk_length,
    branches_length_ratio=Slider(1, range=0..1),
    branches_angle_randomness=Slider(14, range=0..20),
    branches_length_randomness=Slider(56, range=0..100),
    branches_horizontal_distribution=Toggle(True),
    branches_radius_proportion=radius_proportion,
    branches_radius_ratio_extra=Slider(0.709, range=0..1),
    polygon_vertex_count=Slider(5.442, range=0..20),
    verticality=Slider(43, range=0..100),
    branches_growth_opportunity=Slider(44, range=0..100),
    leaf_length=Slider(0.078, range=0..1),
    leaf_width=Slider(0.098, range=0..1),
    leaves_num_max_LP=Slider(6, range=0..20),
    leaves_num_max_LB=Slider(6, range=0..20),
    branch_growth_depth=Slider(5, range=0..20))  # -> leaves, branches_out, trunk_radius; inputs anchor_points: Point3d, branches: Int32, branches_horizontal_distribution: Boolean, leaves_num_max_LB: Int32
# ---------- fractal_tree_generator: Python ----------
"""find the nearest obj index.
    Inputs:
        anchor_points: point3D, anchor point
        depth_recursion: integer, recursion cnt
        branches:integer, maximum amount of horizontal branches
        angle: float, split base angle
        min_h_branches_Spacing: float, minimum horizontal branches spacing
        trunk_length: float, first branch length
        branches_length_ratio: float, length change with each branch
        branches_angle_randomness: float, % of randomness in relation to base angle
        branches_length_randomness: float, % of randomness in relation to base length
        branches_horizontal_distribution: boolean, if horizontal branches evenly spaced or random
        branches_radius_proportion: float, proportion between starting length branch depth and branch radius
        branches_radius_ratio_extra: float, extra radius changes exept for one derived from lvariation
        polygon_vertex_count: interger, starting polygon vertex count
        verticality: float, angle smaller variation with higher branches, adds realism
        branches_growth_opportunity: chance that a branch will stop, increases with depth
        leaf_length: float, length of leaves
        leaf_width: float, width of leaves
        leaves_num_max_LP: int, maximum number of leaves growing from leafpoint
        leaves_num_max_LB: int, maximum number of leaf growth points on last branch
        branch_growth_depth: int, branch depth where leaves grow
        
    Output:
        closest_obj: the closest object
        obj_idx: the closest object index
        closest_point:the nereast point projecting to the closest object
            """

__author__ = "created by Pavlo Menshykh Procedural vegetation for BIM on June 12, 2019  (https://www.linkedin.com/pulse/procedural-vegetation-bim-pavlo-menshykh/); updated by Richie Bao-Chicago.IIT(driverless city project) on Wed Jan 20 12:19:17 2021"
__version__ = "2021.01.2"

ghenv.Component.Name = 'fractal tree generator'
ghenv.Component.NickName = 'fractal tree generator'
ghenv.Component.Message = '0.0.1'
ghenv.Component.Category = 'driverless-city'
ghenv.Component.SubCategory = '0 :: SQL'
ghenv.Component.AdditionalHelpFromDocStrings = '5'


#importing grasshopper python modules
import rhinoscriptsyntax as rs
import Rhino.Geometry as rg
import ghpythonlib.components as ghc
        
#importing generic modules
from math import cos
from math import sin
from math import radians
import random
from math import degrees

        
#getting starting point from anchor_pointsoint
x1 = anchor_points.X
y1 = anchor_points.Y
z1 = anchor_points.Z-trunk_length #to generate starting vector
        
#setting base variables
x2 = x1
y2 = y1 
z2 = anchor_points.Z #to generate starting vector
        
#setting first polygon
radiusbase = trunk_length/branches_radius_proportion
trunk_radius=radiusbase

stpntbase = rg.Point3d(x1, y1, z1)
stpntbaseend = rg.Point3d(x2, y2, z2)
vecbase = rg.Line(stpntbase, stpntbaseend)
plnbase = ghc.PlaneNormal(stpntbaseend, vecbase) #returns a plane perp to a vector
polygonbase = ghc.Polygon(plnbase, radiusbase, polygon_vertex_count, 0)[0] #returns a polygon and its perimeter

        
#base angle
anglerec = 0
anglerech = 0
cluster = [1]
branch_cluster = cluster[0]
        
verticality /= 100
branches_growth_opportunity /= 100
polygon_vertex_count -= 1 #first polygon_vertex_count is defined outside recursive func, so it should enter it with -1
        
depth = depth_recursion
        
#output list
pgons = {}
branches_out = [] #for debug purposes
leaves = []
        
#recursive function
def fractal(depth, x1, y1, z1, x2, y2, z2, trunk_length, anglerec, angle, branches_length_ratio, branches_angle_randomness, branches_length_randomness, anglerech, min_h_branches_Spacing, branches, verticality, branches_growth_opportunity, depth_recursion, branches_radius_proportion, branches_radius_ratio_extra, polygon_vertex_count, polygon, branch_cluster):
            
    #test if depth>0
    if depth:
        
        #defining random angle variation and trunk_length variation
        arn = random.uniform(-angle/100*branches_angle_randomness, angle/100*branches_angle_randomness)
        lrn = random.uniform(-trunk_length/100*branches_length_randomness, trunk_length/100*branches_length_randomness)
                
        if branches_horizontal_distribution == True:
            #defining horizontal rotation angles
            ahor = random.sample(range(0,360), branches)
            #removing numbers within tolerance
            ahr = rs.CullDuplicateNumbers(ahor, min_h_branches_Spacing)
            #in a 360 fashion
            if ahr[0]+360-min_h_branches_Spacing<ahr[-1]:
                del ahr[0]
        else:
            #generating evenly distributed angles
            ahr = range(0, 360+1, 360//branches)[:-1]
                
        #previous branch vector
        vecst = rg.Point3d(x1, y1, z1)
        vecend = rg.Point3d(x2, y2, z2)
        movevec = ghc.Vector2Pt(vecst, vecend, True)[0] #returns vector and it's trunk_length
                
        #perpendicular vector 
        rotplane3 = ghc.PlaneNormal(vecend, movevec) #creates plane perpendicular to vector
        plns = ghc.DeconstructPlane(rotplane3) #origin, x, y, z
        rotplane = ghc.ConstructPlane(plns[2], plns[1], plns[3]) #constructing new plane switching x and y planes to make perpendicular
                
        #generating perpendicular vector
        vecperp = ghc.Rotate(movevec, radians(90), rotplane)[0]
                
        #generating vector amplitudes
        leny = (trunk_length+lrn)*sin(radians((anglerec+arn)*(1-(verticality**depth))))
        lenz = (trunk_length+lrn)*cos(radians(anglerec+arn))
        ampy = ghc.Amplitude(vecperp, leny)
        ampz = ghc.Amplitude(movevec, lenz)
                
        #changing branch trunk_length dependant on branch depth
        trunk_length = trunk_length*branches_length_ratio
                
        #building points
        endpoint1 = ghc.Move(vecend, ampz)[0] #returns moved object and transformation data
        endpoint = ghc.Move(endpoint1, ampy)[0] #returns moved object and transformation data
                
        #rotating point in a cone fashion
        rotpoint = ghc.Rotate3D(endpoint, radians(anglerech), vecend, movevec)[0] #returns rotated geometry and transformation data
                
        #building line between points
        linegeo = rg.Line(vecend, rotpoint)
                
        #defining recursion depth
        key = depth_recursion+1-depth
                
        #building geometry
        pln = ghc.PlaneNormal(rotpoint, linegeo) #returns a plane perp to a vector
        radius = trunk_length*(branches_radius_ratio_extra**(key))/branches_radius_proportion
                
        #reduce details with each branch, but not less than 3
        splits = 3 if polygon_vertex_count-key+1 <= 3 else polygon_vertex_count-key+1
                
        polygonend = ghc.Polygon(pln, radius, splits, 0)[0] #returns a polygon and its perimeter
                
        #aligning curves for loft creation
        crvst = ghc.EndPoints(polygon)[0]
        pntcld = ghc.Discontinuity(polygonend, 1) #returns points and point parameters
                
        #finind seam point
        closest_point = ghc.ClosestPoint(crvst, pntcld[0]) #returns closest point, closest point index, distance between closest points
        seampnt = pntcld[1][closest_point[1]]
        polygonend = ghc.Seam(polygonend, seampnt)
                
        lcurves = [polygon, polygonend]
                
        #building geometry
        geo = ghc.ExtrudePoint(polygon, rotpoint) if depth == 1 and splits == 3 else rg.Brep.CreateFromLoft(lcurves, rg.Point3d.Unset, rg.Point3d.Unset, rg.LoftType.Normal, False)[0]#if last branch than make a pyramid
        #make solid
        geocapped = ghc.CapHoles(geo)
                
        #building a dict of geo with depth as key, and geo as values
        pgons.update({branch_cluster:[geocapped]}) if branch_cluster not in pgons.keys() else pgons[branch_cluster].append(geocapped)
        branches_out.append(geocapped)
                
        #setting coords for next branch
        x1 = x2
        y1 = y2
        z1 = z2
                
        #getting xyz from rotated point
        x2 = rg.Point3d(rotpoint)[0]
        y2 = rg.Point3d(rotpoint)[1]
        z2 = rg.Point3d(rotpoint)[2]
                
        #setting base polygon for next branch
        polygon = polygonend
                
        #filling dict with branch clusters
        cluster.append(cluster[-1]+1)
        branch_cluster=cluster[-1]
                
        #calling function with different angle parameter for branch splitting, calling as many branches as spread within tolerance
        if depth != 1:
            for aa in ahr:
                if ((random.randint(40, 99)/100)**depth) < branches_growth_opportunity or depth == depth_recursion+1: #or added to prevent blank trees
                    fractal(depth - 1 , x1, y1, z1, x2, y2, z2, trunk_length, angle, angle, branches_length_ratio, branches_angle_randomness, branches_length_randomness, aa, min_h_branches_Spacing, branches, verticality, branches_growth_opportunity, depth_recursion, branches_radius_proportion, branches_radius_ratio_extra, polygon_vertex_count, polygon, branch_cluster)
        #leaf logic
        if depth <= branch_growth_depth and leaves_num_max_LB > 0 and leaves_num_max_LP > 0:
                    
            #vector for leaf growth spread
            leafpntvec = ghc.Vector2Pt(vecend, rotpoint, True)[0]
                    
            #setting leaf growth position on last barnch, leafpnt list
            lastbranchlength = ghc.Length(linegeo)
            leaves_list = [lastbranchlength] 
              #[leaves_list.append(lengthparam) for lengthparam in random.sample(range(0, int(lastbranchlength)), leaves_num_max_LB-1)] if leaves_num_max_LB > 1 else None
                    
            for leafpnt in leaves_list:
                leafamp = ghc.Amplitude(leafpntvec, leafpnt)
                leafpoint = ghc.Move(vecend, leafamp)[0]
                        
                #plane for leaf generation
                linetocenter = ghc.Line(stpntbase, leafpoint)
                planetocenter = ghc.PlaneNormal(leafpoint, linetocenter)
                        
                #create an imaginary circle with leaf_length radius and populate it with points for random leaf generation
                leafgenerationcircle = ghc.CircleCNR(leafpoint, linetocenter, leaf_length)
                circlesurf = ghc.BoundarySurfaces(leafgenerationcircle)
                leafcnt = random.randint(0, leaves_num_max_LP)
                if leafcnt > 0:
                    leafendpnts = ghc.PopulateGeometry(circlesurf, leafcnt, random.randint(1,500)) 
                            
                    def leafgenerator(point):
                        #random z move
                        zmove = rg.Vector3d(0, 0, 1)
                        moveamp = random.uniform(-leaf_length/3, leaf_length/5)
                        ampzmove = ghc.Amplitude(zmove, moveamp)
                        llendpnt = ghc.Move(point, ampzmove)[0]
                                
                        #setting a leaf centerline vector
                        leafvector = ghc.Vector2Pt(leafpoint, llendpnt, True)[0]
                        #defining leaf center point as avarage of st and end pnts
                        midpnt = ghc.Average([leafpoint, llendpnt])
                                
                        #generating perpendicular vector
                        vecperpleaf = ghc.Rotate(leafvector, radians(90), planetocenter)[0]
                        leafperpamp = ghc.Amplitude(vecperpleaf, random.uniform((leaf_width/2)/5*4, (leaf_width/2)/5*6))
                                
                        #moving mid point to both sides
                        midpnt1 = ghc.Move(midpnt, leafperpamp)[0]
                        midpnt2 = ghc.Move(midpnt, -leafperpamp)[0]
                                
                        #leaf geo
                        leafgeo = rg.NurbsSurface.CreateFromCorners(leafpoint, midpnt1, llendpnt, midpnt2)
                        leaves.append(leafgeo)
                            
                    #iterate over random number of generated points if list, else generate for one point
                    [leafgenerator(pp) for pp in leafendpnts] if isinstance(leafendpnts, list) else leafgenerator(leafendpnts)
                    
#first recursive function call
fractal(depth, x1, y1, z1, x2, y2, z2, trunk_length, anglerec, angle, branches_length_ratio, branches_angle_randomness, branches_length_randomness, anglerech, min_h_branches_Spacing, branches, verticality, branches_growth_opportunity, depth_recursion, branches_radius_proportion, branches_radius_ratio_extra, polygon_vertex_count, polygonbase, branch_cluster)
# ---------- end fractal_tree_generator ----------
panel = Panel(fractal_tree_generator.trunk_radius)
param_viewer = ParamViewer(fractal_tree_generator.leaves)
param_viewer_2 = ParamViewer(fractal_tree_generator.branches_out)
